# Grasshopper definition calculate_lengths.gh (Grasshopper 1.0.4)

python = GhPythonScript()  # -> out, cd
# ---------- python: Python ----------
path = ghenv.Component.OnPingDocument().FilePath

separator = '/'
split = path.split(separator)
print split

if len(split) < 2:
    separator = '\\'
    split = path.split(separator)

cd = separator.join(split[:-1]) + separator + "mesh" + separator
# ---------- end python ----------
python_script = PythonScript(cd=python.cd)  # -> out, vertices, faces
# ---------- python_script: Python ----------
import Rhino.Geometry as rg
file = open(cd + 'mesh.obj')
lines = file.readlines()
vertices=[]
faces=[]
for line in lines:
    if line.find("v")==0 and line.find("n")==-1 and line.find("t")==-1:
        print line.split(' ')
        vertices.Add(rg.Point3d(float((line.split(' '))[1]),float((line.split(' '))[2]),float((line.split(' '))[3])))
    if line.find("f")==0:
        if line.split(' ').Count==4:
            faces.Add(rg.MeshFace(int(line.split(' ')[1].split('/')[0])-1,int(line.split(' ')[2].split('/')[0])-1,int(line.split(' ')[3].split('/')[0])-1))
        if line.split(' ').Count==5:
            faces.Add(rg.MeshFace(int(line.split(' ')[1].split('/')[0])-1,int(line.split(' ')[2].split('/')[0])-1,int(line.split(' ')[3].split('/')[0])-1,int(line.split(' ')[4].split('/')[0])-1))
# ---------- end python_script ----------
conmesh = ConstructMesh(Vertices=python_script.vertices, Faces=python_script.faces)
medges = MeshEdges(Mesh=conmesh)  # -> NakedEdges, InteriorEdges, NonManifoldEdges
merge = Merge(Data1=medges.NakedEdges, Data2=medges.InteriorEdges, Data3=medges.NonManifoldEdges)
len = Length(Curve=merge)
subtraction = Subtraction(A=len, B=Slider(10, range=0..10))
addition = Addition(A=subtraction, B=Slider(2, range=0..10))
python_2 = GhPythonScript(rod_length_list=addition, maximum_length="2000")  # -> flatten(out); inputs rod_length_list: list
# ---------- python_2: Python ----------
class Bin(object):

    def __init__(self):
    
        self.items = []
        self.sum   = 0

    def append(self, item):
        
        self.items.append(item)
        self.sum += item

    def result(self, index):
        
        total = sum(bin.items)
        
        place_holder = '%d\nTOTAL: %.2f\nITEMS: '
        for item in self.items:
            place_holder += '%.2f, '

        place_holder = place_holder[:-2]

        return place_holder % tuple([index, total] + self.items)


def pack(values, max_value):
    
    values = sorted(values, reverse=True)
    
    bins = []

    for item in values:

        for bin in bins:
        
            if bin.sum + item <= max_value:
                bin.append(item)
                break
                
        else:

            bin = Bin()
            bin.append(item)
            bins.append(bin)

    return bins


bins = pack(rod_length_list, maximum_length)

sum_length = 0
for i, bin in enumerate(bins):
    total = sum(bin.items)
    print(bin.result(i + 1))
    sum_length += total

print('\nSUM: %d BINS, TOTAL LENGTH: %.2f' % (len(bins), sum_length))
# ---------- end python_2 ----------
panel = Panel(python_2)
