# Grasshopper definition final_model.gh (Grasshopper 1.0.4)
# plug-ins: Weaverbird, Kangaroo2 Components

panel = Panel("\Users\nico\AppData\Local\conda\conda\envs\python36\python.exe")
python = GhPythonScript()  # -> out, cd
# ---------- python: Python ----------
__author__ = "ytakzk"
__version__ = "2018.12.04"

path = ghenv.Component.OnPingDocument().FilePath

separator = '/'
split = path.split(separator)

if len(split) < 2:
    separator = '\\'
    split = path.split(separator)

cd = separator.join(split[:-1]) + separator
# ---------- end python ----------
panel_2 = Panel(python.cd)
# Run a Server
python_2 = GhPythonScript(
    python="C:\tools\Anaconda2\envs\python36\python.exe",
    cd=python.cd,
    port="9999",
    run=Button(ExpressionNormal="True", ExpressionPressed="False"))  # -> out, s; inputs port: Int32, run: Boolean
# ---------- python_2: Python ----------
__author__ = "ytakzk"
__version__ = "2018.12.04"

import os
import threading
import time
import socket

TCP_IP   = '127.0.0.1'

def establish_server():
        
    command = 'cd %s && %s app.py -port %d' % (cd, python, port) 
    print(command)
    os.system(command)
    
if run:
    print('Run a server')
    t = threading.Thread(target=establish_server)
    t.start()
    
    time.sleep(2)
    
    s = socket.socket(socket.AF_INET, socket.SOCK_STREAM)
    s.connect((TCP_IP, port))
    s.settimeout(0.01)
# ---------- end python_2 ----------
# Model Selecion
python_3 = GhPythonScript(s=python_2.s, index=Slider(170, range=0..8400))  # -> out, succeeded; inputs index: Int32
# ---------- python_3: Python ----------
__author__ = "ytakzk"
__version__ = "2018.12.05"

import time
import socket

succeeded = False
if s:

    message = 'fetch_data__%d;&' % index
    s.send(message)
    
    i = 0
    while i < 300:
        try:
            data = s.recv(1024)
            if data == message[:-2]:
                succeeded = True
                break
                
        except socket.timeout:
            pass
        i += 1
# ---------- end python_3 ----------
# Close Connection
python_4 = GhPythonScript(s=python_2.s, run=Button())  # -> out, a; inputs run: Boolean
# ---------- python_4: Python ----------
__author__ = "ytakzk"
__version__ = "2018.12.05"

if s and run:
    s.send('close__;&')
# ---------- end python_4 ----------
merge = Merge(
    Data1=Slider(0, range=-0.4..0.4),
    Data2=Slider(-0.07, range=-0.4..0.4),
    Data3=Slider(-0.4, range=-0.4..0.4),
    Data4=Slider(-0.2, range=-0.4..0.4),
    Data5=Slider(0.4, range=-0.4..0.4),
    Data6=Slider(0, range=-0.6..0.4),
    Data7=Slider(0, range=-0.6..0.4),
    Data8=Slider(-0.3, range=-0.4..0.4),
    Data9=Slider(0.3, range=-0.6..0.4),
    Data10=Slider(-0.01, range=-0.6..0.4))
panel_3 = Panel(python_2.out)
panel_4 = Panel(python_2.s)
# Manipulation
python_5 = GhPythonScript(s=python_2.s, succeeded=python_3.succeeded, diff_list=merge)  # -> out, succeeded; inputs succeeded: Boolean, diff_list: list
# ---------- python_5: Python ----------
__author__ = "ytakzk"
__version__ = "2018.12.05"

import socket

if s and succeeded:
    
    diff_str = ''
    for i, diff in enumerate(diff_list):
        diff_str += '%d:%.6f,' % (i, diff)
    diff_str = diff_str[:-1]

    message = 'manipulate__%s;&' % diff_str
    s.send(message)
    
    i = 0
    while i < 200:
        try:
            data = s.recv(1024)
            
            if data == message[:-2]:
                succeeded = True
                print('succeeded')
                break
                
        except socket.timeout:
            pass
        i += 1
# ---------- end python_5 ----------
# Pointcloud Visualization
python_6 = GhPythonScript(cd=python.cd, succeeded=python_5.succeeded)  # -> out, point_cloud; inputs succeeded: Boolean
# ---------- python_6: Python ----------
__author__ = "ytakzk"
__version__ = "2018.12.07"

import Rhino.Geometry as rg

file_name = cd + 'pointcloud2mesh/mount/point_cloud.txt'

if succeeded:

    point_cloud = []
    with open(file_name, 'rb') as file:

        lines = file.read().split('\n')[1:]
        
        for l in lines:
            
            vals = l.split(' ')
            
            if not len(vals) == 3:
                continue
            
            x = float(vals[0])
            y = float(vals[1])
            z = float(vals[2])
            
            p = rg.Point3d(x, y, z)
            point_cloud.append(p)
# ---------- end python_6 ----------
python_7 = GhPythonScript(cd=panel_2, threshold=Slider(0.03, range=0..0.5))  # -> out, succeeded; inputs succeeded: Boolean; disabled
# ---------- python_7: Python ----------
__author__ = "ytakzk"
__version__ = "2018.12.10"


import Rhino.Geometry as rg

file_name = cd + 'pointcloud2mesh/mount/point_cloud.txt'

if succeeded:

    point_cloud = []
    with open(file_name, 'rb') as file:

        lines = file.read().split('\n')[1:]
        
        for l in lines:
            
            vals = l.split(' ')
            
            if not len(vals) == 3:
                continue
            
            x = float(vals[0])
            y = float(vals[1])
            z = float(vals[2])
            
            p = rg.Point3d(x, y, z)
            point_cloud.append(p)

available_point_cloud = []

for i, p in enumerate(point_cloud):
    
    is_available = True
    if i >= len(point_cloud) - 1:
        available_point_cloud.append(p)
        break
    
    for q in point_cloud[i+1:]:
        
        d = p.DistanceTo(q)
        if d < threshold:
            is_available = False
            break
            
    if is_available:
        available_point_cloud.append(p)

    available_point_cloud = sorted(available_point_cloud, key=lambda x: x.Z, reverse=True)

    with open(file_name, 'w') as file:

        file.write('%d\n' % len(available_point_cloud))
        
        for p in available_point_cloud:
            
            file.write('%.6f %.6f %.6f\n' % (p.X, p.Y, p.Z))

num = len(point_cloud) - len(available_point_cloud)
print('%d points are decimated' % num)
# ---------- end python_7 ----------
panel_5 = Panel(python_7.out)
# Pointcloud to Mesh
python_8 = GhPythonScript(s=python_2.s, succeeded=python_5.succeeded, alpha=Slider(0, range=0..0.1))  # -> out, succeeded; inputs succeeded: Boolean
# ---------- python_8: Python ----------
__author__ = "ytakzk"
__version__ = "2018.12.05"

import socket

if s and succeeded:
    
    message = 'generate_mesh__%.2f;&' % alpha 
    s.send(message)
    
    i = 0
    while i < 200:
        try:
            data = s.recv(1024)
            
            if data == message[:-2]:
                succeeded = True
                print('succeeded')
                break
                
        except socket.timeout:
            pass
        i += 1
# ---------- end python_8 ----------
# Mesh Visualization
mesh_visualization = GhPythonScript(cd=python.cd, succeeded=python_8.succeeded)  # -> mesh; inputs succeeded: Boolean
# ---------- mesh_visualization: Python ----------
__author__ = "ytakzk"
__version__ = "2018.12.04"

import rhinoscriptsyntax as rs
import Rhino.Geometry as rg

if succeeded:

    path = cd + '/pointcloud2mesh/mount/output.off'

    with open(path, 'r') as file:
        
        vertices = []
        faces = []
        
        for i, l in enumerate(file):
            
            if i < 2:
                continue
                
            vals = l.split(' ')
            
            if len(vals) == 3:
                vals = [float(v) for v in vals]
                vertices.append(vals)
            elif len(vals) == 4:
                vals = [int(v) for v in vals[1:]]
                faces.append(vals)
                
        mesh = rs.AddMesh(vertices, faces)
# ---------- end mesh_visualization ----------
clean = CombineClean(Meshes=mesh_visualization)
unim = UnifyMesh(Mesh=clean)  # -> Result, Count
mesh = Mesh(unim.Result)

# ---- group: scale
panel_6 = Panel("""1200
750
600""")
python_9 = GhPythonScript(mesh=mesh, limit=panel_6, fit_with=Slider(2, range=0..2))  # -> scaled_mesh; inputs limit: list, fit_with: Int32
# ---------- python_9: Python ----------
__author__ = "ytakzk"
__version__ = "2018.12.08"

import rhinoscriptsyntax as rs

box = rs.BoundingBox(mesh)

# domains [[x_min, x_max], [y_min, y_max], [z_min, z_max]]
domain = [
    [999, -999],
    [999, -999],
    [999, -999]
]

for p in box:
    
    for i, v in enumerate(p):
        
        if v < domain[i][0]:
            domain[i][0] = v
            
        elif v > domain[i][1]:
            domain[i][1] = v

max_length = limit[fit_with]

current_length = domain[fit_with][1] - domain[fit_with][0]

scale = max_length / current_length

scaled_mesh = rs.ScaleObject(mesh, [0, 0, 0], [scale, scale, scale], False)
# ---------- end python_9 ----------
mesh_2 = Mesh(python_9)
debox = DeconstructBox(Box=mesh_2)  # -> Plane, X, Y, Z
dedomain = DeconstructDomain(Domain=[debox.X, debox.Y, debox.Z])  # -> Start, End
subtraction = Subtraction(A=dedomain.End, B=dedomain.Start)
panel_7 = Panel(subtraction)

# ----
clean_2 = CombineClean(Meshes=python_9)
preview = CustomPreview(Geometry=clean_2, Material=ColourSwatch(SwatchColor=RGBA(255, 255, 255, 105)))
python_10 = GhPythonScript(m=clean_2, min_length=Slider(126, range=0..1000))  # -> out, decimated_mesh; inputs m: Mesh
# ---------- python_10: Python ----------
__author__ = "ytakzk"
__version__ = "2018.12.07"

import Rhino.Geometry as rg

res = m.CollapseFacesByEdgeLength(False, min_length)
print res, 'edges are decimated.'

decimated_mesh = m
# ---------- end python_10 ----------
medges = MeshEdges(Mesh=python_10.decimated_mesh)  # -> NakedEdges, InteriorEdges, NonManifoldEdges
python_11 = GhPythonScript(m=python_10.decimated_mesh, ratio=Slider(4.3, range=0..10))  # -> out, decimated_mesh; inputs m: Mesh
# ---------- python_11: Python ----------
__author__ = "ytakzk"
__version__ = "2018.12.07"

import Rhino.Geometry as rg

res = m.CollapseFacesByByAspectRatio(ratio)
print res, 'edges are decimated.'

decimated_mesh = m
# ---------- end python_11 ----------
medges_2 = MeshEdges(Mesh=python_11.decimated_mesh)  # -> NakedEdges, InteriorEdges, NonManifoldEdges
clean_3 = CombineClean(Meshes=python_11.decimated_mesh)
panel_8 = Panel("""63,50
36,63
17,36
17,14
1,36
3,36
20,26""")

# ---- group: total length of rods
mesh_3 = Mesh(clean_3)
medges_3 = MeshEdges(Mesh=mesh_3)  # -> NakedEdges, InteriorEdges, NonManifoldEdges
merge_2 = Merge(Data1=medges_3.NakedEdges, Data2=medges_3.InteriorEdges, Data3=medges_3.NonManifoldEdges)
len = Length(Curve=merge_2)
ma = MassAddition(Input=len)  # -> Result, PartialResults

# ---- group: write a mesh as a file
c_script = CSharpScript(in_run=Button(), in_mesh=mesh_3, in_name="mesh\mesh", in_path=panel_2)  # -> out, A; inputs in_run: Boolean, in_mesh: list of Mesh, in_name: String, in_path: String
# ---------- c_script: C# ----------
    if(in_run) {
      path = System.IO.Path.GetDirectoryName(in_path) + "\\" + in_name + ".obj";
      int faceCount = 0;
      using(StreamWriter writer = new StreamWriter(path)) {
        for(int n = 0; n < in_mesh.Count; n++) {
          List<String> vert = new List<String>();
          List<String> face = new List<String>();

          in_mesh[n].Faces.ConvertQuadsToTriangles();
          BoundingBox bbox = in_mesh[n].GetBoundingBox(true);

          for(int i = 0; i < in_mesh[n].Vertices.Count; i++) {
            vert.Add(String.Format("v {0} {1} {2}", in_mesh[n].Vertices[i].X, in_mesh[n].Vertices[i].Y, in_mesh[n].Vertices[i].Z));
          }

          for(int i = 0; i < in_mesh[n].TextureCoordinates.Count; i++) {
            double tx = in_mesh[n].TextureCoordinates[i].X;
            double ty = in_mesh[n].TextureCoordinates[i].Y;
            vert.Add(String.Format("vt " + tx.ToString("F6") + " " + ty.ToString("F6")));
          }

          for(int i = 0; i < in_mesh[n].Normals.Count; i++) {
            vert.Add(String.Format("vn {0} {1} {2}", in_mesh[n].Normals[i].X, in_mesh[n].Normals[i].Y, in_mesh[n].Normals[i].Z));
          }

          for(int i = 0; i < in_mesh[n].Faces.Count; i++) {
            MeshFace f = in_mesh[n].Faces.GetFace(i);
            int fa = f.A + 1 + faceCount;
            int fb = f.B + 1 + faceCount;
            int fc = f.C + 1 + faceCount;
            string fas = fa.ToString();
            string fbs = fb.ToString();
            string fcs = fc.ToString();
            face.Add(String.Format("f " + fas + "/" + fas + "/" + fas + " " + fbs + "/" + fbs + "/" + fbs + " " + fcs + "/" + fcs + "/" + fcs));
          }

          for(int i = 0; i < vert.Count; i++) {
            writer.WriteLine(vert[i]);
          }

          writer.WriteLine("");
          writer.WriteLine("g " + in_name + n.ToString());

          for(int i = 0; i < face.Count; i++) {
            writer.WriteLine(face[i]);
          }
          faceCount += in_mesh[n].Vertices.Count;
        }
      }
    }
    A = path;
# ---------- c_script: C# additional code ----------
  String path;
# ---------- end c_script ----------
panel_9 = Panel(c_script.A)

# ----
panel_10 = Panel("""49
16
51
10""")

# ---- group: locate problematic rods
# must be larger than 4
number_slider = Slider(20, range=0..100)
python_12 = GhPythonScript(mesh=clean_3, target_min_angle=number_slider)  # -> out, min_angle, problematic_rods; inputs mesh: Mesh
# ---------- python_12: Python ----------
__author__ = "ytakzk"
__version__ = "2018.12.11"

import Rhino.Geometry as rg
import math

min_angle = 999
problematic_rods = []

target_min_angle = math.radians(target_min_angle)

for i, c_vertex in enumerate(mesh.TopologyVertices):
    
    connected_vertices = mesh.TopologyVertices.ConnectedTopologyVertices(i)
    
    combination_list = []
    for ji, j in enumerate(connected_vertices):
        for ki, k in enumerate(connected_vertices[ji+1:]):
            combination_list.append([j, k])
            
    for comb in combination_list:
        
        vertex_1 = mesh.TopologyVertices[comb[0]]
        vertex_2 = mesh.TopologyVertices[comb[1]]
        
        vec_c = rg.Vector3d(c_vertex)
        vec_1 = rg.Vector3d(vertex_1)
        vec_2 = rg.Vector3d(vertex_2)
        
        v1 = rg.Vector3d.Subtract(vec_1, vec_c)
        v2 = rg.Vector3d.Subtract(vec_2, vec_c)
        
        angle = rg.Vector3d.VectorAngle(v1, v2)
        
        if angle < target_min_angle:
            l_1 = rg.Line(c_vertex, vertex_1)
            l_2 = rg.Line(c_vertex, vertex_2)
            problematic_rods += [l_1, l_2]
            
        if angle < min_angle:
            min_angle = angle
        
        print angle
# ---------- end python_12 ----------
tan = Tangent(Value=python_12.min_angle)
dupln = RemoveDuplicateLines(Lines=python_12.problematic_rods, Tolerance=0.01)
line = Line(dupln)
deg = Degrees(Radians=python_12.min_angle)
panel_11 = Panel(deg)
multiplication = Multiplication(A=tan, B="10")
panel_12 = Panel(multiplication)

# ----
lng = ListLength(List=line)
panel_13 = Panel(lng)
wbvertices = WeaverbirdsVerticesComponent(MeshClosedPolylinesGroup=clean_3, Weld=True)
python_13 = GhPythonScript(m=clean_3, manually_removed_induces=panel_8, manually_moved_induces=panel_10)  # -> out, pairs, vertices; inputs m: Mesh, manually_removed_induces: list, manually_moved_induces: list of Int32
# ---------- python_13: Python ----------
__author__ = "ytakzk"
__version__ = "2018.12.06"

import Rhino.Geometry as rg
import clr
clr.AddReference("Grasshopper")
import Grasshopper.Kernel.Data.GH_Path as ghpath
import Grasshopper.DataTree as datatree
import System

target_z = 99999.0

for i, v in enumerate(m.TopologyVertices):
    if i in manually_moved_induces and v.Z < target_z:
        target_z = v.Z

removed_induces_list = []
for string in manually_removed_induces:
    arr = string.split(',')
    removed_induces_list.append([int(arr[0]), int(arr[1])])

pairs = datatree[System.Object]()
vertices = datatree[System.Object]()

for i, iv in enumerate(m.TopologyVertices):
    
    induces = m.TopologyVertices.ConnectedTopologyVertices(i)

    if i in manually_moved_induces:
        iv.Z = target_z

    path = ghpath(i)

    for v in induces:
        vertex = m.TopologyVertices[v]
        
        if v in manually_moved_induces:
            vertex.Z = target_z
        
        is_insertable = True
        for arr in removed_induces_list:
            
            if (arr[0] == i and arr[1] == v)or \
               (arr[0] == v and arr[1] == i):
                   print i, v
                   is_insertable = False
                   break
        
        if is_insertable:
            
            pairs.Add(vertex, path)

    vertices.Add(iv, path)
# ---------- end python_13 ----------
sph = Sphere(Base=wbvertices, Radius="15")
preview_2 = CustomPreview(Geometry=[sph, merge_2], Material=ColourSwatch(SwatchColor=RGBA(28, 123, 255, 110)))
python_14 = GhPythonScript(pairs=python_13.pairs, vertices=flatten(python_13.vertices))  # -> out, labels, positions, rods; inputs pairs: tree of Point3d, vertices: list of Point3d
# ---------- python_14: Python ----------
__author__ = "ytakzk"
__version__ = "2018.12.12"

import Rhino.Geometry as rg
import clr
clr.AddReference("Grasshopper")
import Grasshopper.Kernel.Data.GH_Path as ghpath
import Grasshopper.DataTree as datatree
import System

labels = []
positions = []
rods = []

for index, pair in enumerate(pairs.Branches):
    
    for p in pair:
        
        for pair_index, v in enumerate(vertices):
            if p.X == v.X and p.Y == v.Y and p.Z == v.Z:
                break
        
        before, after = (index, pair_index) if index < pair_index else (pair_index, index)
        
        label = '%02d%02d' % (before, after)
        
        if not label in labels:

            v1 = vertices[index]
            
            center = rg.Point3d(
                (v1.X + v.X) * 0.5,
                (v1.Y + v.Y) * 0.5,
                (v1.Z + v.Z) * 0.5
            )
            
            line = rg.Line(v1, v)
            
            rods.append(line)
            positions.append(center)
            labels.append(label)
# ---------- end python_14 ----------
m_vertex = LabelVertex(M=clean_3, S="20", T=0.5, C="True")  # -> out, A, B; inputs M: Mesh
# ---------- m_vertex: VB ----------
    Component.Params.Input(0).Name = "Mesh"
    Component.Params.Input(0).Description = "Open or closed mesh"
    Component.Params.Input(1).Name = "Text Size"
    Component.Params.Input(1).Description = "Optional size of the text object, if blank the size will be averaged from the face"
    Component.Params.Input(2).Name = "Offset"
    Component.Params.Input(2).Description = "Optional The unitized offset from the face vertex to the face center"
    Component.Params.Input(3).Name = "Center"
    Component.Params.Input(3).Description = "If True the text is oriented towards the center of the face, if False along the edge"

    Component.Params.Output(1).Name = "Point"
    Component.Params.Output(1).Description = "The plane at the center of the text object"
    Component.Params.Output(2).Name = "Index"
    Component.Params.Output(2).Description = "The mesh vertex indices"

    'visualization code adapted From work By David Rutten: http://www.grasshopper3d.com/forum/topics/disabling-preview-For-certain - outputs - -a - custom - gh - component

    If m Is Nothing Then m = New mesh
    If (runCount = 0) Then
      tags = New List(Of Rhino.Display.Text3d)
      box = BoundingBox.Empty
      Dim component As IGH_Component = DirectCast(owner, IGH_Component)
      Dim param As IGH_Param = component.Params.Output(1)
      Dim prvObject As IGH_PreviewObject = TryCast(param, IGH_PreviewObject)
      If (prvObject IsNot Nothing) Then prvObject.Hidden = True
    End If
    If (Not m.IsValid) Then Return

    Dim i,j,k,vi As Integer
    Dim plnOut As New list(Of plane)
    Dim idxOut As New list(Of Integer)

    For i = 0 To m.Faces.Count() - 1 Step 1

      Dim trd,rad As Double
      If s = Nothing Then
        rad = (incircle(m.vertices.item(m.Faces.item(i).C), m.vertices.item(m.Faces.item(i).A), m.vertices.item(m.Faces.item(i).B))(1)) / 2
      Else
        rad = s
      End If
      
      Dim cen As point3d
      If m.Faces(i).istriangle() Then
        cen = ((incircle(m.vertices.item(m.Faces.item(i).C), m.vertices.item(m.Faces.item(i).A), m.vertices.item(m.Faces.item(i).B))(0)).origin)
      Else
        cen = m.Faces.GetFaceCenter(i)
      End If
      Dim tvx(3) As Integer
      tvx(0) = m.Faces(i).A
      tvx(1) = m.Faces(i).B
      tvx(2) = m.Faces(i).C
      If m.Faces(i).isquad Then
        k = 3
        tvx(3) = m.Faces(i).D
      Else
        k = 2
      End If
      Dim u() As Integer
      u = appendprepend(k)
      For j = 1 To k + 1 Step 1
        Dim v(2) As point3d
        v(0) = cen
        vi = m.TopologyVertices.MeshVertexIndices(m.Faces.GetTopologicalVertices(i)(u(j)))(0)
        v(1) = m.Vertices(vi)
        v(2) = m.Vertices(m.TopologyVertices.MeshVertexIndices(m.Faces.GetTopologicalVertices(i)(u(j + 1)))(0))
        Dim pln As plane
        If C Then
          pln = New plane(evalP(v(1), v(2), t / 2), (v(2) - v(1)), (v(0) - v(1)))
        Else
          pln = New plane(evalP(v(1), v(0), t), (v(1) - v(0)), (v(2) - v(1)))
          pln.Rotate(math.PI / 2, pln.ZAxis, pln.Origin)
        End If


        plnOut.add(pln)
        trd = rad * ( 1.75 / (CStr(tvx(u(j))).length))
        Dim arrPt() As point3d
        Dim ttag As New Rhino.Display.Text3d(String.Format("{0:0}", tvx(u(j))), plane.WorldXY, trd)
        arrPt = ttag.BoundingBox.GetCorners()

        If c = False Then pln.Origin = pln.Origin - ( pln.YAxis * (arrPt(0).distanceto(arrPt(3)) / 2)) - ( pln.XAxis * (arrPt(0).distanceto(arrPt(1)) / 2))

        Dim tag As New Rhino.Display.Text3d(String.Format("{0:0}", tvx(u(j))), pln, trd)

        tags.Add(tag)
        idxOut.add(tvx(u(j)))
        box.Union(tag.BoundingBox)
      Next
    Next
    A = plnOut
    B = idxOut
# ---------- m_vertex: VB additional code ----------
  Private tags As List(Of Rhino.Display.Text3d)
  Private box As BoundingBox

  'Return a BoundingBox that contains all the geometry you are about to draw.
  Public Overrides ReadOnly Property ClippingBox() As BoundingBox
    Get
      Return box
    End Get
  End Property

  'Draw all meshes in this method.
  Public Overrides Sub DrawViewportMeshes(ByVal args As IGH_PreviewArgs)
  End Sub

  'Draw all wires and points in this method.
  Public Overrides Sub DrawViewportWires(ByVal args As IGH_PreviewArgs)
    If (tags Is Nothing) Then Return
    If (owner.Attributes.Selected ) Then
      For Each tag As Rhino.Display.Text3d In tags
        args.Display.Draw3dText(tag, args.WireColour_Selected)
      Next
    Else
      For Each tag As Rhino.Display.Text3d In tags
        args.Display.Draw3dText(tag, args.WireColour)
      Next
    End If
  End Sub

  Function incircle(ByVal ptA As point3d, ByVal ptb As point3d, ByVal ptC As point3d)
    Dim A, B, D As Double
    Dim rad, pa, s As Double
    Dim x, y, z As Double


    a = ptB.DistanceTo(ptC)
    b = ptA.DistanceTo(ptC)
    d = ptA.DistanceTo(ptB)

    s = (a + b + d) / 2
    pa = math.Sqrt(s * ((s - a) * (s - b) * (s - d)))

    rad = 2 * pa / (a + b + d)

    x = (ptA.x * A + ptB.x * B + ptC.x * D) / (A + B + D)
    y = (ptA.y * A + ptB.y * B + ptC.y * D) / (A + B + D)
    z = (ptA.z * A + ptB.z * B + ptC.z * D) / (A + B + D)
    Dim ptOut As New point3d(x, y, z)
    Dim plnOut As New Plane(ptOut, (ptC - ptB), (ptA - ptOut))

    Return {plnOut,rad}
  End Function

  Private Function appendprepend(ByVal i As Integer)
    Dim srsEnum As IEnumerable(Of Integer) = Enumerable.Range(0, i + 1)
    Dim arrVal As New list(Of Integer)
    arrVal = srsEnum.tolist()
    arrVal.add(0)
    arrVal.insert(0, i)
    Return arrVal.toarray()
  End Function

  Private Function evalP(ByVal op As point3d, ByVal tp As Point3d, ByVal t As Double)
    Return New point3d(op + (tp - op) * t)
  End Function
# ---------- end m_vertex ----------
python_15 = GhPythonScript(pairs=python_13.pairs, vertices=python_13.vertices)  # -> out, edges; inputs pairs: tree of Point3d, vertices: tree of Point3d
# ---------- python_15: Python ----------
__author__ = "ytakzk"
__version__ = "2018.12.11"

import Rhino.Geometry as rg

edges = []

for ps, v in zip(pairs.Branches, vertices.Branches):
    
    v = v[0]
    
    for p in ps:
        l = rg.Line(p, v)
        edges.append(l)
# ---------- end python_15 ----------
ln = Line(StartPoint=python_13.vertices, EndPoint=python_13.pairs)
pipe = Pipe(Curve=python_15.edges, Radius="2", Caps=0)
panel_14 = Panel(ma.Result)
ext = ExtendCurve(Curve=python_14.rods, Type=0, Start="-12", End="-12")
tag = TextTag(Location=python_14.positions, Text=python_14.labels)
len_2 = Length(Curve=ext)
preview_3 = CustomPreview(Geometry=pipe, Material=ColourSwatch(SwatchColor=RGBA(63, 217, 209, 237)))
bar_graph = BarGraph(len, BarColor=RGB(255, 0, 90))
python_16 = GhPythonScript(cd=python.cd, labels=python_14.labels, lengths=len_2, maximum_length="1500")  # -> out, a; inputs labels: list, lengths: list
# ---------- python_16: Python ----------
class Rod(object):
    
    def __init__(self, length, label):
        
        self.length = length
        self.label  = label

class Bin(object):

    def __init__(self):
    
        self.items = []
        self.sum   = 0

    def append(self, item):
        
        self.items.append(item)
        self.sum += item.length

    def result(self, index):
        
        total = self.total_length()
        
        lengths = []
        labels  = []
        place_holder = '%d\nTOTAL: %.2f'
        
        ph_length = '\nLENGTH: '
        ph_label  = '\nLABEL: '
        
        for item in self.items:
            ph_length += '%.2f, '
            ph_label  += '%s, '
            lengths.append(item.length)
            labels.append(item.label)
            
        if index > 0:
            place_holder = '\n' + place_holder
            
        ph_length = ph_length[:-2]
        ph_label  = ph_label[:-2]
        
        place_holder = place_holder + ph_length + ph_label
        return place_holder % tuple([index, total] + lengths + labels)

    def total_length(self):
        
        total = 0
        
        for item in self.items:
            total += item.length
            
        return total

def pack(rods, max_value):
    
    values = sorted(rods, key=lambda x: x.length, reverse=True)
    
    bins = []

    for item in values:

        for bin in bins:
        
            if bin.sum + item.length <= max_value:
                bin.append(item)
                break
                
        else:

            bin = Bin()
            bin.append(item)
            bins.append(bin)

    return bins

rod_list = []

for label, length in zip(labels, lengths):
    rod = Rod(length, label)
    rod_list.append(rod)

bins = pack(rod_list, maximum_length)


result = ''
sum_length = 0
for i, bin in enumerate(bins):
    
    result += bin.result(i)
    total = bin.total_length()
    sum_length += total

print(result)

with open(cd + '/misc/rod.dat', 'w') as file:
    file.write(result)
#print('\nSUM: %d BINS, TOTAL LENGTH: %.2f' % (len(bins), sum_length))
# ---------- end python_16 ----------
panel_15 = Panel(python_14.labels)
