# Grasshopper definition Join_Connection_one.gh (Grasshopper 1.0.7)
# plug-ins: Kangaroo2 Components, DendroGH

pt = ConstructPoint(XCoordinate=0, YCoordinate=0, ZCoordinate=0)
box = Box({Plane=Plane(origin=(-17.10840232, -25.75119481, 0), x=(0, 1, 0), y=(1, 0, 0)), X=Domain(0, 58.36993998), Y=Domain(0, 66.72128272), Z=Domain(0, 2.517027078)})
ln = Line()

# ---- group: main pipe
line = LineSDL(Start=pt, Direction=Vector(0, 0, 1), Length=Slider(12.5, range=0..100))
end = EndPoints(Curve=line)  # -> Start, End

# ----
number_slider = Slider(5, range=0..10)
vsettings = CreateSettings(VoxelSize=Slider(0.1, range=0..1), Bandwidth=1, Isovalue=0, Adaptivity=0.1)
number_slider_2 = Slider(2.5, range=0..10)

# ---- group: grooves
subtraction = Subtraction(A=number_slider, B=number_slider_2)
avr = Average(Input=[number_slider, number_slider_2])
vec2pt = Vector2Pt(PointA=end.Start, PointB=end.End, Unitize=False)  # -> Vector, Length
division = Division(A=subtraction, B=Slider(2, range=0..10))
pl = PlaneNormal(Origin=end.Start, ZAxis=vec2pt.Vector)
subtraction_2 = Subtraction(A=avr, B=division)
deplane = DeconstructPlane(Plane=pl)  # -> Origin, XAxis, YAxis, ZAxis
eval = EvaluateCurve(Curve=reparameterize(line), Parameter=0.5)  # -> Point, Tangent, Angle
number_of_grooves = Slider(5, range=0..10)
amp = Amplitude(Vector=deplane.XAxis, Amplitude=subtraction_2)
scale = Scale(Geometry=line, Center=eval.Point, Factor=Slider(0.788, range=0..1))  # -> Geometry, Transform
move = Move(Geometry=scale.Geometry, Motion=amp)  # -> Geometry, Transform
arrpolar = PolarArray(Geometry=move.Geometry, Plane=pt, Count=number_of_grooves, Angle=6.283185307)  # -> Geometry, Transform

# ----
box_2 = CenterBox(Base=end.Start, X=number_slider, Y=number_slider, Z=number_slider)
vec = VectorXYZ(XComponent=0, YComponent=0, ZComponent=expr("-x", number_slider))  # -> Vector, Length
mbox = MeshBox(Base=box_2, XCount=1, YCount=1, ZCount=1)
move_2 = Move(Geometry=mbox, Motion=vec.Vector)  # -> Geometry, Transform

box_3 = CenterBox(Base=end.End, X=number_slider, Y=number_slider, Z=number_slider)
vec_2 = VectorXYZ(XComponent=0, YComponent=0, ZComponent=number_slider)  # -> Vector, Length
mbox_2 = MeshBox(Base=box_3, XCount=1, YCount=1, ZCount=1)
move_3 = Move(Geometry=mbox_2, Motion=vec_2.Vector)  # -> Geometry, Transform

vcurve = CurveToVolume(Curves=line, CurveRadius=number_slider_2, Settings=vsettings)
vcurve_2 = CurveToVolume(Curves=line, CurveRadius=number_slider, Settings=vsettings)
vdiff = VolumeDifference(VolumeA=vcurve_2, VolumesB=vcurve)
vmesh = MeshToVolume(Mesh=move_3.Geometry, Settings=vsettings)
vmesh_2 = MeshToVolume(Mesh=move_2.Geometry, Settings=vsettings)
vdiff_2 = VolumeDifference(VolumeA=vdiff, VolumesB=[vmesh, vmesh_2])
vcurve_3 = CurveToVolume(Curves=arrpolar.Geometry, CurveRadius=Slider(1, range=0..1), Settings=vsettings)
vdiff_3 = VolumeDifference(VolumeA=vdiff_2, VolumesB=vcurve_3)

eval_2 = EvaluateCurve(Curve=reparameterize(arrpolar.Geometry), Parameter=0.5)  # -> graft(Point), Tangent, Angle
eval_3 = EvaluateCurve(Curve=reparameterize(arrpolar.Geometry), Parameter=Slider(0, range=0..1))  # -> graft(Point), Tangent, Angle
eval_4 = EvaluateCurve(Curve=reparameterize(arrpolar.Geometry), Parameter=Slider(1, range=0..1))  # -> graft(Point), Tangent, Angle
lng = ListLength(List=eval_2.Point)
lng_2 = ListLength(List=eval_4.Point)
lng_3 = ListLength(List=eval_3.Point)
dup = DuplicateData(Data=1, Number=lng, Order=True)
dup_2 = DuplicateData(Data=1, Number=lng_2, Order=True)
dup_3 = DuplicateData(Data=1, Number=lng_3, Order=True)
number_slider_3 = Slider(1.303, range=0..2)
wav = WeightedAverage(Input=flatten(eval_2.Point), Weights=flatten(dup))
wav_2 = WeightedAverage(Input=flatten(eval_4.Point), Weights=flatten(dup_2))
wav_3 = WeightedAverage(Input=flatten(eval_3.Point), Weights=flatten(dup_3))
vec2pt_2 = Vector2Pt(PointA=eval_2.Point, PointB=wav, Unitize=True)  # -> Vector, Length
vec2pt_3 = Vector2Pt(PointA=eval_4.Point, PointB=wav_2, Unitize=True)  # -> Vector, Length
vec2pt_4 = Vector2Pt(PointA=eval_3.Point, PointB=wav_3, Unitize=True)  # -> Vector, Length
amp_2 = Amplitude(Vector=vec2pt_2.Vector, Amplitude=Slider(0.25, range=0..1))
amp_3 = Amplitude(Vector=vec2pt_3.Vector, Amplitude=expr("-x", number_slider_3))
amp_4 = Amplitude(Vector=vec2pt_4.Vector, Amplitude=expr("-x", number_slider_3))
move_4 = Move(Geometry=eval_2.Point, Motion=amp_2)  # -> Geometry, Transform
move_5 = Move(Geometry=eval_4.Point, Motion=amp_3)  # -> Geometry, Transform
move_6 = Move(Geometry=eval_3.Point, Motion=amp_4)  # -> Geometry, Transform
pline = PolyLine(Vertices=[move_6.Geometry, move_4.Geometry, move_5.Geometry], Closed=False)
intcrv = Interpolate(Vertices=[move_6.Geometry, move_4.Geometry, move_5.Geometry], Degree=3, Periodic=False, KnotStyle=1)  # -> Curve, Length, Domain

mvolume = VolumeToMesh(Volume=vdiff_3, VolumeSettings=vsettings)
vdiff_4 = VolumeDifference(VolumeA=vdiff_2, VolumesB=vcurve_3)

eval_5 = EvaluateCurve(Curve=reparameterize(arrpolar.Geometry), Parameter=Tree({0}: [0.25], {1}: [0.75]))  # -> Point, Tangent, Angle
lng_4 = ListLength(List=eval_5.Point)
expression = Expression(x=lng_4, Expression="360/x/2")
rad = Radians(Degrees=expression)
rot3d = Rotate3D(Geometry=eval_5.Point, Angle=rad, Center=deplane.Origin, Axis=deplane.ZAxis)  # -> Geometry, Transform

clean = CombineClean()
move_7 = Move(Geometry=vdiff_4, Motion=Vector(14.05272449, 0, 0))  # -> Geometry, Transform
vpoints = PointsToVolume(Points=rot3d.Geometry, PointRadius=Slider(0.25, range=0..1), Settings=vsettings)
move_8 = Move(Geometry=vpoints, Motion=Vector(14.05272449, 0, 0))  # -> flatten(Geometry), Transform
vunion = VolumeUnion(Volumes=flatten([move_8.Geometry, move_7.Geometry]))
mvolume_2 = VolumeToMesh(Volume=vunion, VolumeSettings=vsettings)
number_slider_4 = Slider(0.356, range=0..1)
vcurve_4 = CurveToVolume(Curves=intcrv.Curve, CurveRadius=number_slider_4, Settings=vsettings)

twist = Twist(Geometry=intcrv.Curve, Axis=line, Angle=Slider(0.26, range=0..1), Infinite=False, Rigid=False)
vcurve_5 = CurveToVolume(Curves=twist, CurveRadius=number_slider_4, Settings=vsettings)
move_9 = Move(Geometry=flatten(vcurve_5), Motion=Vector(28.65821075, 0, 0))  # -> Geometry, Transform
move_10 = Move(Geometry=vdiff_4, Motion=Vector(28.65821075, 0, 0))  # -> Geometry, Transform
vunion_2 = VolumeUnion(Volumes=flatten([move_9.Geometry, move_10.Geometry]))
mvolume_3 = VolumeToMesh(Volume=vunion_2, VolumeSettings=vsettings)

move_11 = Move(Geometry=flatten(vcurve_4), Motion=Vector(28.65821075, 0, 0))  # -> Geometry, Transform
move_12 = Move(Geometry=vdiff_4, Motion=Vector(28.65821075, 0, 0))  # -> Geometry, Transform
vunion_3 = VolumeUnion(Volumes=flatten([move_11.Geometry, move_12.Geometry]))
mvolume_4 = VolumeToMesh(Volume=vunion_3, VolumeSettings=vsettings)
