# Grasshopper definition joint_connector_generalized.gh (Grasshopper 1.0.7)
# plug-ins: EleFront, Weaverbird, Kangaroo2 Components, DendroGH

python = GhPythonScript()  # -> out, cd
# ---------- python: Python ----------
path = ghenv.Component.OnPingDocument().FilePath

separator = '/'
split = path.split(separator)
print split

if len(split) < 2:
    separator = '\\'
    split = path.split(separator)

cd = separator.join(split[:-3]) + separator + "mesh" + separator
# ---------- end python ----------
python_2 = GhPythonScript()  # -> out, cd
# ---------- python_2: Python ----------
__author__ = "ytakzk"
__version__ = "2018.12.04"

path = ghenv.Component.OnPingDocument().FilePath

separator = '/'
split = path.split(separator)
print split

if len(split) < 2:
    separator = '\\'
    split = path.split(separator)

cd = separator.join(split[:-1]) + separator
# ---------- end python_2 ----------
panel = Panel(python_2.cd)
panel_2 = Panel(python.cd)
python_script = PythonScript(cd=python.cd)  # -> out, vertices, faces
# ---------- python_script: Python ----------
import Rhino.Geometry as rg
file = open(cd + 'mesh.obj')
lines = file.readlines()
vertices=[]
faces=[]
for line in lines:
    if line.find("v")==0 and line.find("n")==-1 and line.find("t")==-1:
        print line.split(' ')
        vertices.Add(rg.Point3d(float((line.split(' '))[1]),float((line.split(' '))[2]),float((line.split(' '))[3])))
    if line.find("f")==0:
        if line.split(' ').Count==4:
            faces.Add(rg.MeshFace(int(line.split(' ')[1].split('/')[0])-1,int(line.split(' ')[2].split('/')[0])-1,int(line.split(' ')[3].split('/')[0])-1))
        if line.split(' ').Count==5:
            faces.Add(rg.MeshFace(int(line.split(' ')[1].split('/')[0])-1,int(line.split(' ')[2].split('/')[0])-1,int(line.split(' ')[3].split('/')[0])-1,int(line.split(' ')[4].split('/')[0])-1))
# ---------- end python_script ----------
construct_mesh = ConstructMesh(Vertices=python_script.vertices, Faces=python_script.faces)
node_index = Slider(16, range=0..100)
panel_3 = Panel("""63,50
36,63
17,36
17,14
1,36
3,36
20,26""")
number_slider = Slider(2, range=0..10)
panel_4 = Panel("""49
16
51
10""")
mesh = Mesh(construct_mesh)

# ---- group: debug
node_index_2 = Slider(28, range=0..100)
python_3 = GhPythonScript(m=mesh, x=node_index_2)  # -> out, pairs, vertices; inputs m: Mesh, x: Int32
# ---------- python_3: Python ----------
__author__ = "ytakzk"
__version__ = "2018.12.06"

import Rhino.Geometry as rg
import clr
clr.AddReference("Grasshopper")
import Grasshopper.Kernel.Data.GH_Path as ghpath
import Grasshopper.DataTree as datatree
import System

pairs = datatree[System.Object]()
vertices = datatree[System.Object]()

if x == "None":
    print " no vertex index given"
    x = 0

for i, v in enumerate(m.TopologyVertices, x):
    print i
    induces = m.TopologyVertices.ConnectedTopologyVertices(i)

    path = ghpath(i)

    for v in induces:
        vertex = m.TopologyVertices[v]
        pairs.Add(vertex, path)
    
    vertices.Add(m.TopologyVertices[i], path)
    
    if i == x+2:
        break
# ---------- end python_3 ----------

# ----
python_4 = GhPythonScript(m=mesh)  # -> out, pairs, vertices; inputs m: Mesh
# ---------- python_4: Python ----------
__author__ = "ytakzk"
__version__ = "2018.12.06"

import Rhino.Geometry as rg
import clr
clr.AddReference("Grasshopper")
import Grasshopper.Kernel.Data.GH_Path as ghpath
import Grasshopper.DataTree as datatree
import System

pairs = datatree[System.Object]()
vertices = datatree[System.Object]()

for i, v in enumerate(m.TopologyVertices):
    
    induces = m.TopologyVertices.ConnectedTopologyVertices(i)

    path = ghpath(i)

    for v in induces:
        vertex = m.TopologyVertices[v]
        pairs.Add(vertex, path)
    
    vertices.Add(m.TopologyVertices[i], path)
# ---------- end python_4 ----------
toggle = BooleanToggle(False)
python_5 = GhPythonScript(
    m=mesh,
    manually_removed_induces=panel_3,
    manually_moved_induces=panel_4,
    x=node_index,
    num_of_nodes=number_slider,
    debug=toggle)  # -> out, pairs, vertices; inputs m: Mesh, manually_removed_induces: list, manually_moved_induces: list of Int32, x: Int32, num_of_nodes: Int32, debug: Boolean
# ---------- python_5: Python ----------
__author__ = "ytakzk"
__version__ = "2018.12.06"

import Rhino.Geometry as rg
import clr
clr.AddReference("Grasshopper")
import Grasshopper.Kernel.Data.GH_Path as ghpath
import Grasshopper.DataTree as datatree
import System

target_z = 99999.0

if not debug:
    x = 0

for i, v in enumerate(m.TopologyVertices):
    if i in manually_moved_induces and v.Z < target_z:
        target_z = v.Z

removed_induces_list = []
for string in manually_removed_induces:
    arr = string.split(',')
    removed_induces_list.append([int(arr[0]), int(arr[1])])

pairs = datatree[System.Object]()
vertices = datatree[System.Object]()

for i, vi in enumerate(m.TopologyVertices, x):
    
    induces = m.TopologyVertices.ConnectedTopologyVertices(i)

    path = ghpath(i)

    for v in induces:
        vertex = m.TopologyVertices[v]
        
        if v in manually_moved_induces:
            vertex.Z = target_z
        
        is_insertable = True
        for arr in removed_induces_list:
            
            if (arr[0] == i and arr[1] == v)or \
               (arr[0] == v and arr[1] == i):
                   print i, v
                   is_insertable = False
                   break
        
        if is_insertable:
            pairs.Add(vertex, path)

    if i in manually_moved_induces:
        vi.Z = target_z

    vertices.Add(vi, path)
    
    if i == x + num_of_nodes and debug:
        break
# ---------- end python_5 ----------
python_6 = GhPythonScript(
    m=mesh,
    manually_removed_induces=panel_3,
    manually_moved_induces=panel_4,
    x=node_index,
    num_of_nodes=number_slider,
    debug=toggle)  # -> out, pairs, vertices; inputs m: Mesh, manually_removed_induces: list, manually_moved_induces: list of Int32, x: Int32, num_of_nodes: Int32, debug: Boolean; same code as python_5
m_vertex = LabelVertex(M=mesh, T=0.5)  # -> out, A, B; inputs M: Mesh
# ---------- m_vertex: VB ----------
    Component.Params.Input(0).Name = "Mesh"
    Component.Params.Input(0).Description = "Open or closed mesh"
    Component.Params.Input(1).Name = "Text Size"
    Component.Params.Input(1).Description = "Optional size of the text object, if blank the size will be averaged from the face"
    Component.Params.Input(2).Name = "Offset"
    Component.Params.Input(2).Description = "Optional The unitized offset from the face vertex to the face center"
    Component.Params.Input(3).Name = "Center"
    Component.Params.Input(3).Description = "If True the text is oriented towards the center of the face, if False along the edge"

    Component.Params.Output(1).Name = "Point"
    Component.Params.Output(1).Description = "The plane at the center of the text object"
    Component.Params.Output(2).Name = "Index"
    Component.Params.Output(2).Description = "The mesh vertex indices"

    'visualization code adapted From work By David Rutten: http://www.grasshopper3d.com/forum/topics/disabling-preview-For-certain - outputs - -a - custom - gh - component

    If m Is Nothing Then m = New mesh
    If (runCount = 0) Then
      tags = New List(Of Rhino.Display.Text3d)
      box = BoundingBox.Empty
      Dim component As IGH_Component = DirectCast(owner, IGH_Component)
      Dim param As IGH_Param = component.Params.Output(1)
      Dim prvObject As IGH_PreviewObject = TryCast(param, IGH_PreviewObject)
      If (prvObject IsNot Nothing) Then prvObject.Hidden = True
    End If
    If (Not m.IsValid) Then Return

    Dim i,j,k,vi As Integer
    Dim plnOut As New list(Of plane)
    Dim idxOut As New list(Of Integer)

    For i = 0 To m.Faces.Count() - 1 Step 1

      Dim trd,rad As Double
      If s = Nothing Then
        rad = (incircle(m.vertices.item(m.Faces.item(i).C), m.vertices.item(m.Faces.item(i).A), m.vertices.item(m.Faces.item(i).B))(1)) / 2
      Else
        rad = s
      End If
      
      Dim cen As point3d
      If m.Faces(i).istriangle() Then
        cen = ((incircle(m.vertices.item(m.Faces.item(i).C), m.vertices.item(m.Faces.item(i).A), m.vertices.item(m.Faces.item(i).B))(0)).origin)
      Else
        cen = m.Faces.GetFaceCenter(i)
      End If
      Dim tvx(3) As Integer
      tvx(0) = m.Faces(i).A
      tvx(1) = m.Faces(i).B
      tvx(2) = m.Faces(i).C
      If m.Faces(i).isquad Then
        k = 3
        tvx(3) = m.Faces(i).D
      Else
        k = 2
      End If
      Dim u() As Integer
      u = appendprepend(k)
      For j = 1 To k + 1 Step 1
        Dim v(2) As point3d
        v(0) = cen
        vi = m.TopologyVertices.MeshVertexIndices(m.Faces.GetTopologicalVertices(i)(u(j)))(0)
        v(1) = m.Vertices(vi)
        v(2) = m.Vertices(m.TopologyVertices.MeshVertexIndices(m.Faces.GetTopologicalVertices(i)(u(j + 1)))(0))
        Dim pln As plane
        If C Then
          pln = New plane(evalP(v(1), v(2), t / 2), (v(2) - v(1)), (v(0) - v(1)))
        Else
          pln = New plane(evalP(v(1), v(0), t), (v(1) - v(0)), (v(2) - v(1)))
          pln.Rotate(math.PI / 2, pln.ZAxis, pln.Origin)
        End If


        plnOut.add(pln)
        trd = rad * ( 1.75 / (CStr(tvx(u(j))).length))
        Dim arrPt() As point3d
        Dim ttag As New Rhino.Display.Text3d(String.Format("{0:0}", tvx(u(j))), plane.WorldXY, trd)
        arrPt = ttag.BoundingBox.GetCorners()

        If c = False Then pln.Origin = pln.Origin - ( pln.YAxis * (arrPt(0).distanceto(arrPt(3)) / 2)) - ( pln.XAxis * (arrPt(0).distanceto(arrPt(1)) / 2))

        Dim tag As New Rhino.Display.Text3d(String.Format("{0:0}", tvx(u(j))), pln, trd)

        tags.Add(tag)
        idxOut.add(tvx(u(j)))
        box.Union(tag.BoundingBox)
      Next
    Next
    A = plnOut
    B = idxOut
# ---------- m_vertex: VB additional code ----------
  Private tags As List(Of Rhino.Display.Text3d)
  Private box As BoundingBox

  'Return a BoundingBox that contains all the geometry you are about to draw.
  Public Overrides ReadOnly Property ClippingBox() As BoundingBox
    Get
      Return box
    End Get
  End Property

  'Draw all meshes in this method.
  Public Overrides Sub DrawViewportMeshes(ByVal args As IGH_PreviewArgs)
  End Sub

  'Draw all wires and points in this method.
  Public Overrides Sub DrawViewportWires(ByVal args As IGH_PreviewArgs)
    If (tags Is Nothing) Then Return
    If (owner.Attributes.Selected ) Then
      For Each tag As Rhino.Display.Text3d In tags
        args.Display.Draw3dText(tag, args.WireColour_Selected)
      Next
    Else
      For Each tag As Rhino.Display.Text3d In tags
        args.Display.Draw3dText(tag, args.WireColour)
      Next
    End If
  End Sub

  Function incircle(ByVal ptA As point3d, ByVal ptb As point3d, ByVal ptC As point3d)
    Dim A, B, D As Double
    Dim rad, pa, s As Double
    Dim x, y, z As Double


    a = ptB.DistanceTo(ptC)
    b = ptA.DistanceTo(ptC)
    d = ptA.DistanceTo(ptB)

    s = (a + b + d) / 2
    pa = math.Sqrt(s * ((s - a) * (s - b) * (s - d)))

    rad = 2 * pa / (a + b + d)

    x = (ptA.x * A + ptB.x * B + ptC.x * D) / (A + B + D)
    y = (ptA.y * A + ptB.y * B + ptC.y * D) / (A + B + D)
    z = (ptA.z * A + ptB.z * B + ptC.z * D) / (A + B + D)
    Dim ptOut As New point3d(x, y, z)
    Dim plnOut As New Plane(ptOut, (ptC - ptB), (ptA - ptOut))

    Return {plnOut,rad}
  End Function

  Private Function appendprepend(ByVal i As Integer)
    Dim srsEnum As IEnumerable(Of Integer) = Enumerable.Range(0, i + 1)
    Dim arrVal As New list(Of Integer)
    arrVal = srsEnum.tolist()
    arrVal.add(0)
    arrVal.insert(0, i)
    Return arrVal.toarray()
  End Function

  Private Function evalP(ByVal op As point3d, ByVal tp As Point3d, ByVal t As Double)
    Return New point3d(op + (tp - op) * t)
  End Function
# ---------- end m_vertex ----------

connection_tolerance_rod_to_joint = Slider(0.2, range=0.01..1)
depth_of_the_rods_in_the_joints = Slider(5, range=0..10)
joint_outer_radius_sphere = Slider(17, range=0..100)
rod_radius_cylinder = Slider(2, range=0.01..10)

# ---- group: size of the table
bbox = BoundingBox(Content=mesh, Plane=PlaneXY(0, 0, 0))  # -> Box, Box_2
debox = DeconstructBox(Box=bbox.Box)  # -> Plane, X, Y, Z
dedomain = DeconstructDomain(Domain=[debox.X, debox.Y, debox.Z])  # -> Start, End
subtraction = Subtraction(A=dedomain.End, B=dedomain.Start)
panel_5 = Panel(subtraction)

# ---- group: rods
medges = MeshEdges(Mesh=mesh)  # -> NakedEdges, InteriorEdges, NonManifoldEdges
merge = Merge(Data1=medges.NakedEdges, Data2=medges.InteriorEdges, Data3=medges.NonManifoldEdges)
pipe = Pipe(Curve=merge, Radius=rod_radius_cylinder, Caps=0)
cap = CapHoles(Brep=pipe)

# ----
ln = Line(StartPoint=python_5.pairs, EndPoint=python_5.vertices)
sph = Sphere(Base=python_5.vertices, Radius=joint_outer_radius_sphere)
ln_2 = Line(StartPoint=python_5.vertices, EndPoint=python_5.pairs)
crv = Curve(ln)
python_7 = GhPythonScript(vertices=python_5.vertices, pairs=python_5.pairs)  # -> out, labels; inputs vertices: tree of Point3d, pairs: tree of Point3d
# ---------- python_7: Python ----------
__author__ = "nico"
__version__ = "2018.12.12"

import rhinoscriptsyntax as rs
import clr
clr.AddReference("Grasshopper")
import Grasshopper.Kernel.Data.GH_Path as ghpath
import Grasshopper.DataTree as datatree
import System

labels = datatree[System.Object]()

for i, pair_path in enumerate(pairs.Paths):
    
    pair = pairs.Branch(pair_path)
    
    for p in pair:
        
        for vertex_index, vs in enumerate(vertices.Branches):
            v = vs[0]
            if p.X == v.X and p.Y == v.Y and p.Z == v.Z:
                break

        if i < vertex_index:
            a = "%02d%02d" % (i, vertex_index)
            print a
        elif i > vertex_index:
            a = "%02d%02d" % (vertex_index, i)
        path = ghpath(i)
        labels.Add(a, path)
    #print i, i[0]
   # for j in y.Paths:
    #    print "i", i, i[0], ", j", j
# ---------- end python_7 ----------
srf = Surface(sph)
len = Length(Curve=merge)
dupln = RemoveDuplicateLines(Lines=flatten(ln_2), Tolerance=0.01)
ma = MassAddition(Input=len)  # -> Result, PartialResults
scx = SurfaceCurve(Surface=srf, Curve=crv)  # -> Curves, Points, UVPoints, Normals, Parameters, Tangents
python_8 = GhPythonScript(duplicate_lines=flatten(ln_2), pruned_lines=dupln)  # -> out, a; inputs duplicate_lines: list of Line, pruned_lines: list of Line
# ---------- python_8: Python ----------
__author__ = "nico"
__version__ = "2018.12.12"

import rhinoscriptsyntax as rs
import Rhino.Geometry as rg

a = []

for dup_line in duplicate_lines:
    temp_bool = False
    for pruned_line in pruned_lines:
        
        if dup_line.PointAt(0).X == pruned_line.PointAt(0).X and \
        dup_line.PointAt(1).X == pruned_line.PointAt(1).X and \
        dup_line.PointAt(0).Y == pruned_line.PointAt(0).Y and \
        dup_line.PointAt(1).Y == pruned_line.PointAt(1).Y and \
        dup_line.PointAt(0).Z == pruned_line.PointAt(0).Z and \
        dup_line.PointAt(1).Z == pruned_line.PointAt(1).Z:
            temp_bool = True
            break
    a.append(temp_bool)
# ---------- end python_8 ----------
bar_graph = BarGraph(len, BarColor=RGB(255, 0, 90))
pshift = ShiftPaths(Data=scx.Points, Offset=-1)
pshift_2 = ShiftPaths(Data=scx.Normals, Offset=-1)
number_slider_2 = Slider(-12, range=-12..-9)
eval = EvaluateCurve(Curve=dupln, Parameter=0.5)  # -> Point, Tangent, Angle
dist = Distance(PointA=pshift, PointB=python_5.vertices)
ext = ExtendCurve(Curve=dupln, Type=0, Start=number_slider_2, End=number_slider_2)
division = Division(A=dist, B=Slider(2, range=0..10))
item = ListItem(List=division, Index=0, Wrap=True)
sph_2 = Sphere(Base=python_5.vertices, Radius=item)
shift = ShiftList(List=pshift, Shift=1, Wrap=True)
srf_2 = Surface(sph_2)
pipe_2 = Pipe(Curve=ext, Radius=2, Caps=1)  # -> simplify(Pipe)
cull = CullPattern(List=flatten(python_7.labels), CullPattern=python_8.a)
button = Button()
geodesic = Geodesic(Surface=srf, Start=pshift, End=shift)
subtraction_2 = Subtraction(A=dist, B=division)
line = LineSDL(Start=pshift, Direction=pshift_2, Length=expr("x/3", division))
planar = Planar(Curve=geodesic)  # -> Planar, Plane, Deviation

# ---- group: vizualization of the cuting planes
ln_3 = Line(StartPoint=pshift, EndPoint=shift)
eval_2 = EvaluateCurve(Curve=reparameterize(ln_3), Parameter=0.5)  # -> Point, Tangent, Angle
pl_origin = PlaneOrigin(Base=planar.Plane, Origin=eval_2.Point)

# ----
line_2 = LineSDL(Start=pshift, Direction=expr("x*-1", pshift_2), Length=subtraction_2)
line_3 = LineSDL(Start=pshift, Direction=expr("x*-1", pshift_2), Length=depth_of_the_rods_in_the_joints)
sec = BrepPlane(Brep=srf_2, Plane=simplify(planar.Plane))  # -> Curves, Points
button_2 = Button()
textdot = DefineTextDot(Text=cull, Location=eval.Point, Font="Arial", Size=20)  # -> simplify(TextDot)
panel_6 = Panel(line_3)
layer = DefineLayer(Name="rods", Color=RGB(255, 255, 255))
pshift_3 = ShiftPaths(Data=textdot, Offset=-1)  # -> simplify(graft(Data))
bakelayer = BakeModifyLayer(Layer=layer, Bake=button)
sec_2 = BrepPlane(Brep=srf, Plane=simplify(planar.Plane))  # -> Curves, Points
bake = BakeObjects(Geometry=[pipe_2, pshift_3], Attributes=layer, BakeName="rods", Bake=button, groupObject=True)

outter_stripe_width = Slider(3.7, range=2..10)
inner_stripe_width = Slider(2.5, range=2..10)
rod_holder_outer_radius_cylinder = Slider(3.5, range=0..10)

tapering_of_inner_hole = Slider(0.462, range=0..1)
vsettings = CreateSettings(VoxelSize=Slider(0.2, range=0..1), Bandwidth=1, Isovalue=0.002, Adaptivity=0.1)
position_of_the_screw_holes = Slider(0.75, range=0..1)
addition = Addition(A=rod_radius_cylinder, B=connection_tolerance_rod_to_joint)
addition_2 = Addition(A=addition, B=tapering_of_inner_hole)
dom = ConstructDomain(DomainStart=addition, DomainEnd=addition_2)
number_slider_3 = Slider(10, range=0..10)
range = Range(Domain=dom, Steps=number_slider_3)
geo = Geometry(line_3)
eval_3 = EvaluateCurve(Curve=line_3, Parameter=position_of_the_screw_holes)  # -> Point, Tangent, Angle
lng = ListLength(List=range)
lng_2 = ListLength(List=line_3)
divide = DivideCurve(Curve=line_3, Count=number_slider_3, Kinks=False)  # -> Points, Tangents, Parameters
pshift_4 = ShiftPaths(Data=sec.Curves, Offset=-1)
item_2 = ListItem(List=division, Index=0, Wrap=True)
pshift_5 = ShiftPaths(Data=sec_2.Curves, Offset=-1)
pl = PlaneNormal(Origin=eval_3.Point, ZAxis=eval_3.Tangent)
multiplication = Multiplication(A=lng, B=lng_2)  # -> simplify(Result)
repeat = RepeatData(Data=range, Length=multiplication)
labeling_pattern_multiplication = Slider(1, range=0..10)
pshift_6 = ShiftPaths(Data=repeat, Offset=-1)  # -> simplify(Data)
pshift_7 = ShiftPaths(Data=divide.Points, Offset=-1)
deplane = DeconstructPlane(Plane=pl)  # -> Origin, unitize(XAxis), unitize(YAxis), unitize(ZAxis)
popgeo = PopulateGeometry(Geometry=srf, Count=1, Seed=1, Points=pshift)
vcurve = CurveToVolume(Curves=pshift_5, CurveRadius=expr("x/5", outter_stripe_width), Settings=vsettings)
vcurve_2 = CurveToVolume(Curves=pshift_5, CurveRadius=expr("x/2", outter_stripe_width), Settings=vsettings)
vcurve_3 = CurveToVolume(Curves=pshift_4, CurveRadius=expr("x/2", inner_stripe_width), Settings=vsettings)
item_3 = ListItem(List=division, Index=0, Wrap=True)
vpoints = PointsToVolume(Points=python_5.vertices, PointRadius=joint_outer_radius_sphere, Settings=vsettings)
vcurve_4 = CurveToVolume(Curves=line_2, CurveRadius=rod_holder_outer_radius_cylinder, Settings=vsettings)
vpoints_2 = PointsToVolume(Points=python_5.vertices, PointRadius=item_2, Settings=vsettings)
vcurve_5 = CurveToVolume(Curves=line, CurveRadius=addition, Settings=vsettings)
vpoints_3 = PointsToVolume(Points=pshift_7, PointRadius=pshift_6, Settings=vsettings)
number_slider_4 = Slider(1, range=1..5)
amp = Amplitude(Vector=deplane.XAxis, Amplitude=expr("-x", rod_holder_outer_radius_cylinder))
amp_2 = Amplitude(Vector=deplane.YAxis, Amplitude=expr("-x", rod_holder_outer_radius_cylinder))
sph_3 = Sphere(Base=python_5.vertices, Radius=item_3)
amp_3 = Amplitude(Vector=deplane.XAxis, Amplitude=rod_holder_outer_radius_cylinder)
amp_4 = Amplitude(Vector=deplane.YAxis, Amplitude=rod_holder_outer_radius_cylinder)
ln_4 = Line(StartPoint=python_5.vertices, EndPoint=popgeo)
pl_2 = PlaneNormal(Origin=popgeo, ZAxis=ln_4)
srf_3 = Surface(sph_3)
move = Move(Geometry=deplane.Origin, Motion=amp_3)  # -> Geometry, Transform
move_2 = Move(Geometry=deplane.Origin, Motion=amp_4)  # -> Geometry, Transform
move_3 = Move(Geometry=deplane.Origin, Motion=amp)  # -> Geometry, Transform
move_4 = Move(Geometry=deplane.Origin, Motion=amp_2)  # -> Geometry, Transform
vint = VolumeIntersection(VolumeA=vpoints, VolumesB=vcurve_2)
vint_2 = VolumeIntersection(VolumeA=vpoints, VolumesB=vcurve_4)
dom_2 = ConstructDomain(DomainStart=expr("-x", labeling_pattern_multiplication), DomainEnd=labeling_pattern_multiplication)
xy = XYPlane(Origin=Point(0, 0, 0))
pl_origin_2 = PlaneOrigin(Base=pl_2, Origin=python_5.vertices)
lng_3 = ListLength(List=flatten(python_5.vertices))
ln_5 = Line(StartPoint=move_2.Geometry, EndPoint=move_4.Geometry)
scx_2 = SurfaceCurve(Surface=srf_3, Curve=ln_4)  # -> Curves, Points, UVPoints, Normals, Parameters, Tangents
ln_6 = Line(StartPoint=move.Geometry, EndPoint=move_3.Geometry)
div = DivideDomain(Domain=dom_2, Count=number_slider_4)
planesrf = PlaneSurface(Plane=xy, XSize=dom_2, YSize=dom_2)
crossref = CrossReference(ListA=div, ListB=div, CrossMode=1)  # -> ListA, ListB
rotate = Rotate(Geometry=ln_6, Angle=2.073451151, Plane=pl)  # -> Geometry, Transform
rotate_2 = Rotate(Geometry=ln_6, Angle=1.036725576, Plane=pl)  # -> Geometry, Transform
series = Series(Start=0, Step=1, Count=lng_3)
pl_3 = PlaneNormal(Origin=scx_2.Points, ZAxis=scx_2.Normals)
amp_5 = Amplitude(Vector=scx_2.Normals, Amplitude=Slider(2, range=0..10))
vunion = VolumeUnion(Volumes=[vint_2, vpoints_2, vint, vcurve])
qsph = QuadSphere(Base=pl_origin_2, Radius=item_2)
dom² = ConstructDomain²(DomainU=crossref.ListA, DomainV=crossref.ListB)
merge_2 = Merge(Data1=ln_6, Data2=rotate_2.Geometry, Data4=rotate.Geometry)
move_5 = Move(Geometry=pl_3, Motion=expr("-x", amp_5))  # -> Geometry, Transform
debrep = DeconstructBrep(Brep=qsph)  # -> Faces, Edges, Vertices
vsmooth = SmoothVolume(Volume=vunion, Width=Slider(0.4, range=0..10), Type=2, Iterations=1)
subsrf = Isotrim(Surface=planesrf, Domain=dom²)
pshift_8 = ShiftPaths(Data=series, Offset=-1)  # -> simplify(graft(Data))
vcurve_6 = CurveToVolume(Curves=merge_2, CurveRadius=Slider(0.6, range=0..1), Settings=vsettings)
vunion_2 = VolumeUnion(Volumes=[vcurve_5, vpoints_3, vcurve_6])
area = Area(Geometry=subsrf)  # -> Area, Centroid
debrep_2 = DeconstructBrep(Brep=planesrf)  # -> Faces, Edges, Vertices
eval_4 = EvaluateCurve(Curve=reparameterize(debrep_2.Edges), Parameter=0.5)  # -> Point, Tangent, Angle
text = DefineTextObject(Text=pshift_8, Plane=move_5.Geometry, DimensionStyle="Default02", OutputType="Curve")
scale = Scale(Geometry=text, Center=move_5.Geometry, Factor=Slider(5, range=0..10))  # -> simplify(Geometry), Transform
area_2 = Area(Geometry=debrep_2.Faces)  # -> Area, Centroid
item_4 = ListItem(List=debrep_2.Vertices, Index=0, Wrap=True)
item_5 = ListItem(List=debrep_2.Vertices, Index=1, Wrap=True)
item_6 = ListItem(List=debrep_2.Vertices, Index=2, Wrap=True)
item_7 = ListItem(List=debrep_2.Vertices, Index=3, Wrap=True)
item_8 = ListItem(List=eval_4.Point, Index=0, Wrap=True)
item_9 = ListItem(List=eval_4.Point, Index=1, Wrap=True)
item_10 = ListItem(List=eval_4.Point, Index=2, Wrap=True)
item_11 = ListItem(List=eval_4.Point, Index=3, Wrap=True)
project = Project(Curve=scale.Geometry, Brep=srf_3, Direction=scx_2.Normals)  # -> simplify(Curve)
ln_7 = Line(StartPoint=item_10, EndPoint=item_11)
ln_8 = Line(StartPoint=item_10, EndPoint=item_9)
pshift_9 = ShiftPaths(Data=project, Offset=-1)
eval_5 = EvaluateCurve(Curve=reparameterize(ln_7), Parameter=0.5)  # -> Point, Tangent, Angle
eval_6 = EvaluateCurve(Curve=reparameterize(ln_8), Parameter=0.5)  # -> Point, Tangent, Angle
ln_9 = Line(StartPoint=area_2.Centroid, EndPoint=item_11)
ln_10 = Line(StartPoint=area_2.Centroid, EndPoint=item_4)
ln_11 = Line(StartPoint=area_2.Centroid, EndPoint=item_8)
ln_12 = Line(StartPoint=area_2.Centroid, EndPoint=item_5)
ln_13 = Line(StartPoint=area_2.Centroid, EndPoint=item_9)
ln_14 = Line(StartPoint=area_2.Centroid, EndPoint=item_6)
ln_15 = Line(StartPoint=area_2.Centroid, EndPoint=item_10)
vcurve_7 = CurveToVolume(Curves=pshift_9, CurveRadius=Slider(0.9, range=0..1), Settings=vsettings)
ln_16 = Line(StartPoint=eval_5.Point, EndPoint=eval_6.Point)
line_4 = Line(flatten([debrep_2.Edges, ln_7, ln_16]))
python_9 = GhPythonScript(number=series, base=flatten(line_4), l0=ln_9, l1=ln_10, l2=ln_11, l3=ln_12, l4=ln_13, l5=ln_14, l6=ln_15)  # -> out, numbering_pattern, lines; inputs number: Int32, base: list of Line, l0: Line, l1: Line, l2: Line, l3: Line, l4: Line, l5: Line, l6: Line
# ---------- python_9: Python ----------
__author__ = "nico"
__version__ = "2018.12.11"

import rhinoscriptsyntax as rs
import Rhino.Geometry as rg

num = "{0:07b}".format(number)
numbering_pattern = []


#create a list of lines for the binary representation
lines = []
lines.append(l6)
lines.append(l5)
lines.append(l4)
lines.append(l3)
lines.append(l2)
lines.append(l1)
lines.append(l0)

print num
#create pattern
temp_pat = []
for i, char in enumerate(num):
    print char
    if int(char) == 1:
        print i
        numbering_pattern.append(lines[i])
        
print temp_pat
for i in base:
    numbering_pattern.append(i)


#numbering_pattern.append(temp_pat)
# ---------- end python_9 ----------
division_2 = Division(A=1, B=number_slider_4)
vec2pt = Vector2Pt(PointA=xy, PointB=area.Centroid, Unitize=False)  # -> Vector, Length
geo_2 = Geometry(simplify(python_9.numbering_pattern))
geo_3 = Geometry(python_9.lines)
textdot_2 = DefineTextDot(Text=graft(series), Location=python_5.vertices, Font="Arial", Size=20)  # -> simplify(TextDot)
tag = TextTag(Location=python_5.vertices, Text=graft(series))
reb = RebuildCurve(Curve=geo_2, Count=10, Tangents=False)
scale_2 = Scale(Geometry=reb, Center=xy, Factor=division_2)  # -> graft(Geometry), Transform
move_6 = Move(Geometry=scale_2.Geometry, Motion=vec2pt.Vector)  # -> Geometry, Transform
geo_4 = Geometry(simplify(graft(debrep.Faces)))
pshift_10 = ShiftPaths(Data=move_6.Geometry, Offset=-1)
python_10 = GhPythonScript(x=pshift_10)  # -> out, tree; inputs x: tree of Curve
# ---------- python_10: Python ----------
__author__ = "ytakzk"
__version__ = "2018.12.11"

import rhinoscriptsyntax as rs

import clr
clr.AddReference("Grasshopper")
import Grasshopper.Kernel.Data.GH_Path as ghpath
import Grasshopper.DataTree as datatree
import System
 
tree = datatree[System.Object]()

for i, values in enumerate(x.Branches):
    
    for j in range(6):
        path = ghpath(i, j)
        
        for v in values:
            tree.Add(v, path)
# ---------- end python_10 ----------
label_engraving_height = Slider(0.6, range=0..1)
map_srf = MapToSurface(Curve=python_10.tree, Source=planesrf, Target=geo_4)
pshift_11 = ShiftPaths(Data=map_srf, Offset=-1)
vcurve_8 = CurveToVolume(Curves=pshift_11, CurveRadius=label_engraving_height, Settings=vsettings)
volume = Volume(simplify(vcurve_8))
vunion_3 = VolumeUnion(Volumes=[vcurve_7, vsmooth, volume])
vdiff = VolumeDifference(VolumeA=vunion_3, VolumesB=vunion_2)
vsmooth_2 = SmoothVolume(Volume=vdiff, Width=Slider(0.1, range=0..10), Type=2, Iterations=1)
mvolume = VolumeToMesh(Volume=vsmooth_2, VolumeSettings=vsettings)
clean = CombineClean(Meshes=mvolume)
wblaplace = WeaverbirdsLaplacianSmoothing(MeshCurves=clean, Level=1, SmoothNakedEdges=1, Thin=1)  # -> simplify(OutputMeshCurves)
bake_2 = BakeObjects(Geometry=[wblaplace, textdot_2], BakeName="joints", Bake=Button(), groupObject=True)
panel_7 = Panel(bake_2)
