# Grasshopper definition Geodesic_joint_0_0_1.gh (Grasshopper 1.0.7)
# plug-ins: Kangaroo2 Components, DendroGH

number_slider = Slider(25, range=0..100)
pt = Point(Point(42.85008012, 57.35809117, 0))
crv = Curve([<curve referenced from the Rhino model> x4])
srf = Surface(<surface referenced from the Rhino model>)
sph = Sphere(Base=pt, Radius=number_slider)
scx = SurfaceCurve(Surface=srf, Curve=crv)  # -> Curves, flatten(Points), UVPoints, flatten(Normals), Parameters, Tangents
volume = Volume(Geometry=srf)  # -> Volume, Centroid
shift = ShiftList(List=scx.Points, Shift=1, Wrap=True)
dist = Distance(PointA=scx.Points, PointB=volume.Centroid)
pl = PlaneNormal(Origin=scx.Points, ZAxis=scx.Normals)
geodesic = Geodesic(Surface=srf, Start=scx.Points, End=shift)
number_slider_2 = Slider(4, range=0..10)
division = Division(A=dist, B=Slider(2, range=0..10))
planar = Planar(Curve=geodesic)  # -> Planar, Plane, Deviation
cyl = Cylinder(Base=pl, Radius=Slider(2.6, range=0..10), Length=expr("x*-1", division))
sec = BrepPlane(Brep=srf, Plane=planar.Plane)  # -> Curves, Points
line = LineSDL(Start=scx.Points, Direction=expr("x*-1", scx.Normals), Length=division)
multiplication = Multiplication(A=[Slider(-1, range=-1..0), Slider(1, range=0..1)], B=number_slider_2)
vsettings = CreateSettings(VoxelSize=Slider(0.3, range=0..1), Bandwidth=1, Isovalue=0, Adaptivity=0.1)
offsets = OffsetOnSrf(Curve=sec.Curves, Distance=multiplication, Surface=srf)
item = ListItem(List=division, Index=0, Wrap=True)
crv_2 = Curve(flatten(offsets))
vcurve = CurveToVolume(Curves=line, CurveRadius=Slider(2.6, range=0..10), Settings=vsettings)
vcurve_2 = CurveToVolume(Curves=line, CurveRadius=Slider(5, range=0..10), Settings=vsettings)
vcurve_3 = CurveToVolume(Curves=sec.Curves, CurveRadius=number_slider_2, Settings=vsettings)
vpoints = PointsToVolume(Points=volume.Centroid, PointRadius=item, Settings=vsettings)
vpoints_2 = PointsToVolume(Points=volume.Centroid, PointRadius=number_slider, Settings=vsettings)
cull = CullPattern(List=crv_2, CullPattern=[False, True])  # -> graft(List)
cull_2 = CullPattern(List=crv_2, CullPattern=[True, False])  # -> graft(List)
loft = Loft(Curves=[cull, cull_2], Options={Adjust=False, Closed=False, LoftEnds=0, LoftSimp=0, LoftType=0, Rebuild=10, Refit=0.01})
vint = VolumeIntersection(VolumeA=vpoints_2, VolumesB=vcurve_3)  # -> flatten(Result)
vint_2 = VolumeIntersection(VolumeA=vpoints_2, VolumesB=vcurve_2)
extr = Extrude()
vunion = VolumeUnion(Volumes=[vint_2, vpoints, vint])
vdiff = VolumeDifference(VolumeA=vunion, VolumesB=vcurve)
mvolume = VolumeToMesh(Volume=vdiff, VolumeSettings=vsettings)
clean = CombineClean(Meshes=mvolume)
