# Grasshopper definition joint_connector.gh (Grasshopper 1.0.4)
# plug-ins: Kangaroo2 Components, DendroGH

number_slider = Slider(25, range=0..100)
mesh = Mesh(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)
python = GhPythonScript(m=mesh)  # -> out, pairs, vertices; inputs m: Mesh
# ---------- python: Python ----------
__author__ = "ytakzk"
__version__ = "2018.12.06"

import Rhino.Geometry as rg
import clr
clr.AddReference("Grasshopper")
import Grasshopper.Kernel.Data.GH_Path as ghpath
import Grasshopper.DataTree as datatree
import System

pairs = datatree[System.Object]()
vertices = datatree[System.Object]()

for i, v in enumerate(m.TopologyVertices):
    
    induces = m.TopologyVertices.ConnectedTopologyVertices(i)

    path = ghpath(i)

    for v in induces:
        vertex = m.TopologyVertices[v]
        pairs.Add(vertex, path)
    
    vertices.Add(m.TopologyVertices[i], path)
# ---------- end python ----------
sph = Sphere(Base=PlaneXY(0, 0, 0), Radius=number_slider)
ln = Line(StartPoint=python.pairs, EndPoint=python.vertices)
sph_2 = Sphere(Base=python.vertices, Radius=number_slider)
medges = MeshEdges(Mesh=mesh)  # -> NakedEdges, InteriorEdges, NonManifoldEdges
crv = Curve(ln)
srf = Surface(sph_2)
merge = Merge(Data1=medges.NakedEdges, Data2=medges.InteriorEdges, Data3=medges.NonManifoldEdges)
scx = SurfaceCurve(Surface=srf, Curve=crv)  # -> Curves, Points, UVPoints, Normals, Parameters, Tangents
len = Length(Curve=merge)
volume = Volume(Geometry=srf)  # -> Volume, Centroid
pipe = Pipe(Curve=merge, Radius=Slider(2.5, range=0..10), Caps=0)
pshift = ShiftPaths(Data=scx.Points, Offset=-1)
pshift_2 = ShiftPaths(Data=scx.Normals, Offset=-1)
ma = MassAddition(Input=len)  # -> Result, PartialResults
panel = Panel(len)
dist = Distance(PointA=pshift, PointB=volume.Centroid)
cap = CapHoles(Brep=pipe)
panel_2 = Panel(ma.Result)
shift = ShiftList(List=pshift_2, Shift=1, Wrap=True)
geodesic = Geodesic(Surface=srf, Start=pshift, End=shift)
number_slider_2 = Slider(4, range=0..10)
division = Division(A=dist, B=Slider(2, range=0..10))
planar = Planar(Curve=geodesic)  # -> Planar, Plane, Deviation
line = LineSDL(Start=pshift, Direction=expr("x*-1", pshift_2), Length=division)
multiplication = Multiplication(A=[Slider(-1, range=-1..0), Slider(1, range=0..1)], B=number_slider_2)
vsettings = CreateSettings(VoxelSize=Slider(1, range=0..1), Bandwidth=1, Isovalue=0, Adaptivity=0.1)
sec = BrepPlane(Brep=srf, Plane=simplify(planar.Plane))  # -> Curves, Points
item = ListItem(List=division, Index=0, Wrap=True)
pshift_3 = ShiftPaths(Data=sec.Curves, Offset=-1)
vcurve = CurveToVolume(Curves=line, CurveRadius=Slider(2.6, range=0..10), Settings=vsettings)
vcurve_2 = CurveToVolume(Curves=line, CurveRadius=Slider(5, range=0..10), Settings=vsettings)
vcurve_3 = CurveToVolume(Curves=pshift_3, CurveRadius=number_slider_2, Settings=vsettings)
vpoints = PointsToVolume(Points=volume.Centroid, PointRadius=item, Settings=vsettings)
vpoints_2 = PointsToVolume(Points=volume.Centroid, PointRadius=number_slider, Settings=vsettings)
vint = VolumeIntersection(VolumeA=vpoints_2, VolumesB=vcurve_3)  # -> flatten(Result)
vint_2 = VolumeIntersection(VolumeA=vpoints_2, VolumesB=vcurve_2)
vunion = VolumeUnion(Volumes=[vint_2, vpoints, vint])
vdiff = VolumeDifference(VolumeA=vunion, VolumesB=vcurve)
mvolume = VolumeToMesh(Volume=vdiff, VolumeSettings=vsettings)
clean = CombineClean(Meshes=mvolume)
