# Grasshopper definition mesh_reader.gh (Grasshopper 1.0.4)

python = GhPythonScript()  # -> out, cd
# ---------- python: Python ----------
__author__ = "ytakzk"
__version__ = "2018.12.04"

path = ghenv.Component.OnPingDocument().FilePath

separator = '/'
split = path.split(separator)

if len(split) < 2:
    separator = '\\'
    split = path.split(separator)

cd = separator.join(split[:-1]) + separator
# ---------- end python ----------
panel = Panel(python.cd)
python_script = PythonScript(cd=python.cd)  # -> out, vertices, faces
# ---------- python_script: Python ----------
import Rhino.Geometry as rg
file = open(cd + 'mesh.obj')
lines = file.readlines()
vertices=[]
faces=[]
for line in lines:
    if line.find("v")==0 and line.find("n")==-1 and line.find("t")==-1:
        print line.split(' ')
        vertices.Add(rg.Point3d(float((line.split(' '))[1]),float((line.split(' '))[2]),float((line.split(' '))[3])))
    if line.find("f")==0:
        if line.split(' ').Count==4:
            faces.Add(rg.MeshFace(int(line.split(' ')[1].split('/')[0])-1,int(line.split(' ')[2].split('/')[0])-1,int(line.split(' ')[3].split('/')[0])-1))
        if line.split(' ').Count==5:
            faces.Add(rg.MeshFace(int(line.split(' ')[1].split('/')[0])-1,int(line.split(' ')[2].split('/')[0])-1,int(line.split(' ')[3].split('/')[0])-1,int(line.split(' ')[4].split('/')[0])-1))
# ---------- end python_script ----------
construct_mesh = ConstructMesh(Vertices=python_script.vertices, Faces=python_script.faces)
