# Grasshopper definition connect_closest_points.gh (Grasshopper 1.0.4)

number_slider = Slider(0.3, range=0..1)
box = CenterBox(Base=PlaneXY(0, 0, 0), X=number_slider, Y=number_slider, Z=number_slider)
python = GhPythonScript(
    directory="C:\Users\ytakzk\ml\DeepTable\table_generator\data\csv\",
    index=Slider(2, range=0..8000),
    interval=Slider(3, range=1..50))  # -> out, point_cloud; inputs index: Int32, interval: Int32
# ---------- python: Python ----------
__author__ = "ytakzk"
__version__ = "2018.12.08"

import rhinoscriptsyntax as rs
import Rhino.Geometry as rg
import glob
import csv

file_names = glob.glob(directory + '/*.csv')

point_cloud = []

file_name = file_names[index]

with open(file_name, 'rb') as file:

    reader = csv.reader(file, delimiter=',')
    for i, row in enumerate(reader):
        
        if i % interval != 0:
            continue
    
        x = float(row[0])
        y = float(row[1])
        z = float(row[2])

        p = rg.Point3d(x, y, z)
        point_cloud.append(p)
# ---------- end python ----------
pop3d = Populate3D(Region=box, Count=Slider(50, range=0..100), Seed=1)
python_2 = GhPythonScript(pt=pop3d)  # -> out, lines; inputs pt: list of Point3d
# ---------- python_2: Python ----------
__author__ = "ytakzk"
__version__ = "2018.12.08"

import Rhino.Geometry as rg

lines = []

for p in pt:
    
    faces = sorted(pt, key=lambda q: q.DistanceTo(p))[:4]
    
    for p1, p2 in zip(faces, faces[1:] + [faces[0]]):
        l = rg.Line(p1, p2)
        lines.append(l)
# ---------- end python_2 ----------
python_3 = GhPythonScript(pt=python.point_cloud)  # -> out, lines; inputs pt: list of Point3d; same code as python_2
X = UnitX(Factor=1)
move = Move(Geometry=python_2.lines, Motion=X)  # -> Geometry, Transform
