# Grasshopper definition 2d_mapping.gh (Grasshopper 1.0.4)

python = GhPythonScript()  # -> out, cd
# ---------- python: Python ----------
__author__ = "ytakzk"
__version__ = "2018.12.04"

path = ghenv.Component.OnPingDocument().FilePath

separator = '/'
split = path.split(separator)

if len(split) < 2:
    separator = '\\'
    split = path.split(separator)

cd = separator.join(split[:-1]) + separator
# ---------- end python ----------
number_slider = Slider(200, range=0..200)
python_2 = GhPythonScript(cd=python.cd)  # -> path
# ---------- python_2: Python ----------
__author__ = "ytakzk"
__version__ = "2018.12.09"

import rhinoscriptsyntax as rs


arr = cd.split('\\')[:-3]

path = '\\'.join(arr) + '\\'
# ---------- end python_2 ----------
python_3 = GhPythonScript(path=python_2)  # -> out, diffs
# ---------- python_3: Python ----------
__author__ = "ytakzk"
__version__ = "2018.12.13"

import csv
import Rhino.Geometry as rg


csv_path = path + '2d_vector.csv'

diffs = []

with open(csv_path) as file:
    
    reader = csv.reader(file)
    
    for vals in reader:
        
        y = float(vals[0])
        z = float(vals[1])
        
        vec = rg.Vector3d(0, y, z)
        
        diffs.append(vec)
# ---------- end python_3 ----------
panel = Panel(python_3.diffs)
panel_2 = Panel(python_2)
python_4 = GhPythonScript(path=python_2, column=Slider(3, range=0..10), nums=number_slider)  # -> out, input; inputs nums: Int32
# ---------- python_4: Python ----------
__author__ = "ytakzk"
__version__ = "2018.12.09"

import Rhino.Geometry as rg
import glob
import csv

import clr
clr.AddReference("Grasshopper")
import Grasshopper.Kernel.Data.GH_Path as ghpath
import Grasshopper.DataTree as datatree
 
import System

path = '\\'.join(path.split('\\') + ['table_generator', 'data']) + '\\'
print path
csv_path     = path + 'csv\*.csv'
decoded_path = path + 'decoded\*.txt'

csv_files     = sorted(glob.glob(csv_path))[:nums]
decoded_files = sorted(glob.glob(decoded_path))[:nums]

input  = datatree[System.Object]()
output = datatree[System.Object]()

for i, csv_file in enumerate(csv_files):

    path = ghpath(i)

    with open(csv_file, 'r') as file:
        
        reader = csv.reader(file, delimiter=',')
        
        for row in reader:
#            if len(row) == 1:
#                continue
            
            x = float(row[0])
            y = float(row[1])
            z = float(row[2])
            
            p = rg.Point3d(x, y, z)
            
            input.Add(p, path)
# ---------- end python_4 ----------
split = SplitList(List=python_3.diffs, Index=number_slider)  # -> ListA, ListB
graft = GraftTree(Tree=split.ListA, IncludeEmptyLists=True, IncludeNullItems=True)  # -> simplify(Tree)
pt = Point(python_4.input)
multiplication = Multiplication(A=graft, B=Slider(0.4, range=0..1))
move = Move(Geometry=pt, Motion=multiplication)  # -> Geometry, Transform
