# Grasshopper definition dataset.gh (Grasshopper 1.0.4)

python = GhPythonScript(
    directory="C:\Users\ytakzk\ml\DeepTable\table_generator\data\csv\",
    columns=Slider(10, range=0..10),
    horizontal_diff=Slider(1.5, range=0..10),
    vertical_diff=Slider(1.3, range=0..10))  # -> out, horizontal_point_clouds, vertical_point_clouds; inputs columns: Int32
# ---------- python: Python ----------
__author__ = "ytakzk"
__version__ = "2018.12.06"

import Rhino.Geometry as rg
import clr
clr.AddReference("Grasshopper")
import Grasshopper.Kernel.Data.GH_Path as ghpath
import Grasshopper.DataTree as datatree
import System
import glob
import csv

file_names = glob.glob(directory + '/*.csv')

horizontal_point_clouds = datatree[System.Object]()
vertical_point_clouds   = datatree[System.Object]()

for i, file_name in enumerate(file_names):
    
    x_order = i % columns
    y_order = int(i / columns)
    x_diff = horizontal_diff * x_order
    y_diff = horizontal_diff * y_order
    
    path = ghpath(i)
    with open(file_name, 'rb') as file:
        
        reader = csv.reader(file, delimiter=',')
        for row in reader:
            
            x = float(row[0])
            y = float(row[1])
            z = float(row[2])
            
            
            p = rg.Point3d(x + x_diff, y + y_diff, z)
            horizontal_point_clouds.Add(p, path)
            
            
            if i < 60:

                p = rg.Point3d(x, y + horizontal_diff * (i % 3), z + vertical_diff * int(i / 3))
                vertical_point_clouds.Add(p, path)
# ---------- end python ----------
pt = Point(python.vertical_point_clouds)
pt_2 = Point(python.horizontal_point_clouds)
