# Grasshopper definition dataset_autoencoder.gh (Grasshopper 1.0.4)

python = GhPythonScript()  # -> out, cd
# ---------- python: Python ----------
__author__ = "ytakzk"
__version__ = "2018.12.04"

path = ghenv.Component.OnPingDocument().FilePath

separator = '/'
split = path.split(separator)

if len(split) < 2:
    separator = '\\'
    split = path.split(separator)

cd = separator.join(split[:-1]) + separator
# ---------- end python ----------
python_2 = GhPythonScript(cd=python.cd)  # -> path
# ---------- python_2: Python ----------
__author__ = "ytakzk"
__version__ = "2018.12.09"

import rhinoscriptsyntax as rs


arr = cd.split('\\')[:-3]

path = '\\'.join(arr) + '\\'
# ---------- end python_2 ----------
python_3 = GhPythonScript(path=python_2, column=Slider(3, range=0..10))  # -> out, input, output
# ---------- python_3: Python ----------
__author__ = "ytakzk"
__version__ = "2018.12.09"

import Rhino.Geometry as rg
import glob
import csv

import clr
clr.AddReference("Grasshopper")
import Grasshopper.Kernel.Data.GH_Path as ghpath
import Grasshopper.DataTree as datatree
 
import System

path = '\\'.join(path.split('\\') + ['table_generator', 'data']) + '\\'
print path
csv_path     = path + 'csv\*.csv'
decoded_path = path + 'decoded\*.txt'

#csv_files     = sorted(glob.glob(csv_path))[:10]
decoded_files = sorted(glob.glob(decoded_path))[:30]

input  = datatree[System.Object]()
output = datatree[System.Object]()

for i, decoded_file in enumerate(decoded_files):

    path = ghpath(i)
    
    csv_file = decoded_file.replace('decoded', 'csv').replace('txt', 'csv')

    y_diff = 1.5 * (i % 3)
    z_diff = 1.5 * int(i / 3)

    with open(csv_file, 'r') as file:
        
        reader = csv.reader(file, delimiter=',')

        for row in reader:
            
            x = float(row[0])
            y = float(row[1])
            z = float(row[2])
            
            p = rg.Point3d(x, y + y_diff, z + z_diff)
            
            input.Add(p, path)

    with open(decoded_file, 'r') as file:
        
        reader = csv.reader(file, delimiter=' ')

        for row in reader:
            
            if len(row) != 3:
                continue
            
            x = float(row[0])
            y = float(row[1])
            z = float(row[2])
            
            p = rg.Point3d(x, y + y_diff + 10, z + z_diff)
            
            output.Add(p, path)
# ---------- end python_3 ----------
panel = Panel(python_2)
pt = Point(python_3.input)
pt_2 = Point(python_3.output)
panel_2 = Panel("\Users\nico\AppData\Local\conda\conda\envs\python36\python.exe")
# Run a Server
python_4 = GhPythonScript(
    python="C:\tools\Anaconda2\envs\python36\python.exe",
    cd=python_2,
    port="9999",
    run=Button(ExpressionNormal="True", ExpressionPressed="False"))  # -> out, s; inputs port: Int32, run: Boolean
# ---------- python_4: Python ----------
__author__ = "ytakzk"
__version__ = "2018.12.04"

import os
import threading
import time
import socket

TCP_IP   = '127.0.0.1'

def establish_server():
        
    command = 'cd %s && %s app.py -port %d' % (cd, python, port) 
    print(command)
    os.system(command)
    
if run:
    print('Run a server')
    t = threading.Thread(target=establish_server)
    t.start()
    
    time.sleep(2)
    
    s = socket.socket(socket.AF_INET, socket.SOCK_STREAM)
    s.connect((TCP_IP, port))
    s.settimeout(0.01)
# ---------- end python_4 ----------
python_5 = GhPythonScript(s=python_4.s, cd=python_2)  # -> out, succeeded
# ---------- python_5: Python ----------
__author__ = "ytakzk"
__version__ = "2018.12.05"

import time
import socket
import glob
import shutil
import time

path = cd + 'table_generator/data/04379243/*.ply'

paths = sorted(glob.glob(path))[:50]

if s:

    for i, p in enumerate(paths):
        
        print i 
        message = 'fetch_data__%d;&' % i
        s.send(message)

        i = 0
        while i < 300:
            try:
                data = s.recv(1024)
            
                if data == message:
                    break
                
            except socket.timeout:
                pass
            i += 1

        message = 'manipulate__0:0;&'
        s.send(message)

        i = 0
        while i < 300:
            try:
                data = s.recv(1024)
            
                if data == message:
                    break
                
            except socket.timeout:
                pass
            i += 1
            
        src = cd + 'pointcloud2mesh/mount/point_cloud.txt'
        
        dst = p.replace('04379243', 'decoded').replace('ply', 'txt')
        shutil.copyfile(src, dst)
# ---------- end python_5 ----------
panel_3 = Panel(python_4.s)
panel_4 = Panel(python_4.out)
