# Grasshopper definition workflow.gh (Grasshopper 1.0.7)
# plug-ins: Weaverbird, Kangaroo2 Components

panel = Panel("C:\tools\Anaconda2\envs\python36\python.exe")
panel_2 = Panel("\Users\nico\AppData\Local\conda\conda\envs\python36\python.exe")
python = GhPythonScript()  # -> out, cd
# ---------- python: Python ----------
__author__ = "ytakzk"
__version__ = "2018.12.04"

path = ghenv.Component.OnPingDocument().FilePath

separator = '/'
split = path.split(separator)

if len(split) < 2:
    separator = '\\'
    split = path.split(separator)

cd = separator.join(split[:-1]) + separator
# ---------- end python ----------
panel_3 = Panel(python.cd)
# Run a Server
python_2 = GhPythonScript(python=panel_2, cd=python.cd, port="9999", run=Button(ExpressionNormal="True", ExpressionPressed="False"))  # -> out, s; inputs port: Int32, run: Boolean
# ---------- python_2: Python ----------
__author__ = "ytakzk"
__version__ = "2018.12.04"

import os
import threading
import time
import socket

TCP_IP   = '127.0.0.1'

def establish_server():
        
    command = 'cd %s && %s app.py -port %d' % (cd, python, port) 
    print(command)
    os.system(command)
    
if run:
    print('Run a server')
    t = threading.Thread(target=establish_server)
    t.start()
    
    time.sleep(2)
    
    s = socket.socket(socket.AF_INET, socket.SOCK_STREAM)
    s.connect((TCP_IP, port))
    s.settimeout(0.01)
# ---------- end python_2 ----------
# Model Selecion
python_3 = GhPythonScript(s=python_2.s, index=Slider(10, range=0..8400))  # -> out, succeeded; inputs index: Int32
# ---------- python_3: Python ----------
__author__ = "ytakzk"
__version__ = "2018.12.05"

import time
import socket

succeeded = False
if s:

    message = 'fetch_data__%d' % index
    s.send(message)
    
    i = 0
    while i < 300:
        try:
            data = s.recv(1024)
            
            if data == message:
                succeeded = True
                break
                
        except socket.timeout:
            pass
        i += 1
# ---------- end python_3 ----------
# Close Connection
python_4 = GhPythonScript(s=python_2.s, run=Button())  # -> out, a; inputs run: Boolean
# ---------- python_4: Python ----------
__author__ = "ytakzk"
__version__ = "2018.12.05"

if s and run:
    s.send('close__')
# ---------- end python_4 ----------
merge = Merge(
    Data1=Slider(0.1, range=-1..1),
    Data2=Slider(0, range=-1..1),
    Data3=Slider(0, range=-1..1),
    Data4=Slider(0, range=-1..1),
    Data5=Slider(0, range=-1..1),
    Data6=Slider(0, range=-1..1),
    Data7=Slider(0, range=-1..1),
    Data8=Slider(0, range=-1..1))
panel_4 = Panel(python_2.out)
panel_5 = Panel(python_2.s)
# Manipulation
python_5 = GhPythonScript(s=python_2.s, succeeded=python_3.succeeded, diff_list=merge)  # -> out, succeeded; inputs succeeded: Boolean, diff_list: list
# ---------- python_5: Python ----------
__author__ = "ytakzk"
__version__ = "2018.12.05"

import socket

if s and succeeded:
    
    diff_str = ''
    for i, diff in enumerate(diff_list):
        diff_str += '%d:%.6f,' % (i, diff)
    diff_str = diff_str[:-1]

    message = 'manipulate__%s' % diff_str
    s.send(message)
    
    i = 0
    while i < 200:
        try:
            data = s.recv(1024)
            
            if data == message:
                succeeded = True
                print('succeeded')
                break
                
        except socket.timeout:
            pass
        i += 1
# ---------- end python_5 ----------
# Pointcloud Generation
python_6 = GhPythonScript(s=python_2.s, succeeded=python_5.succeeded)  # -> out, succeeded; inputs succeeded: Boolean
# ---------- python_6: Python ----------
__author__ = "ytakzk"
__version__ = "2018.12.05"

import socket

if s and succeeded:
    
    message = 'generate_pointcloud__' 
    s.send(message)
    
    i = 0
    while i < 200:
        try:
            data = s.recv(1024)
            
            if data == message:
                succeeded = True
                print('succeeded')
                break
                
        except socket.timeout:
            pass
        i += 1
# ---------- end python_6 ----------
# Pointcloud to Mesh
python_7 = GhPythonScript(s=python_2.s, succeeded=python_5.succeeded, alpha=Slider(0.01, range=0..0.1))  # -> out, succeeded; inputs succeeded: Boolean
# ---------- python_7: Python ----------
__author__ = "ytakzk"
__version__ = "2018.12.05"

import socket

if s and succeeded:
    
    message = 'generate_mesh__%.2f' % alpha 
    s.send(message)
    
    i = 0
    while i < 200:
        try:
            data = s.recv(1024)
            
            if data == message:
                succeeded = True
                print('succeeded')
                break
                
        except socket.timeout:
            pass
        i += 1
# ---------- end python_7 ----------
# Pointcloud Visualization
python_8 = GhPythonScript(cd=python.cd, succeeded=python_6.succeeded)  # -> out, point_cloud; inputs succeeded: Boolean
# ---------- python_8: Python ----------
__author__ = "ytakzk"
__version__ = "2018.12.07"

import Rhino.Geometry as rg

file_name = cd + 'pointcloud2mesh/mount/point_cloud.txt'

if succeeded:

    point_cloud = []
    with open(file_name, 'rb') as file:

        lines = file.read().split('\n')[1:]
        
        for l in lines:
            
            vals = l.split(' ')
            
            if not len(vals) == 3:
                continue
            
            x = float(vals[0])
            y = float(vals[1])
            z = float(vals[2])
            
            p = rg.Point3d(x, y, z)
            point_cloud.append(p)
# ---------- end python_8 ----------
# Mesh Visualization
mesh_visualization = GhPythonScript(cd=python.cd, succeeded=python_7.succeeded)  # -> mesh; inputs succeeded: Boolean
# ---------- mesh_visualization: Python ----------
__author__ = "ytakzk"
__version__ = "2018.12.04"

import rhinoscriptsyntax as rs
import Rhino.Geometry as rg

if succeeded:

    path = cd + '/pointcloud2mesh/mount/output.off'

    with open(path, 'r') as file:
        
        vertices = []
        faces = []
        
        for i, l in enumerate(file):
            
            if i < 2:
                continue
                
            vals = l.split(' ')
            
            if len(vals) == 3:
                vals = [float(v) for v in vals]
                vertices.append(vals)
            elif len(vals) == 4:
                vals = [int(v) for v in vals[1:]]
                faces.append(vals)
                
        mesh = rs.AddMesh(vertices, faces)
# ---------- end mesh_visualization ----------
clean = CombineClean(Meshes=mesh_visualization)
vcell = VoronoiCell()
unim = UnifyMesh(Mesh=clean)  # -> Result, Count
voronoi³ = Voronoi3D(Points=python_8.point_cloud)  # -> Cells, Boundary
custom_mesh_settings = SettingsCustom(
    StitchSeams=True,
    SimplePlanes=False,
    Refine=True,
    MinCount=16,
    MaxCount=400,
    AspectRatio=20,
    MaxDistance=0,
    MaxAngle=20,
    MinEdge=0,
    MaxEdge=0)
mesh = Mesh(unim.Result)
cull = CullPattern(List=voronoi³.Cells, CullPattern=invert(voronoi³.Boundary))

# ---- group: scale
panel_6 = Panel("""1200
750
700""")
python_9 = GhPythonScript(mesh=mesh, limit=panel_6, fit_with=Slider(2, range=0..2))  # -> scaled_mesh; inputs limit: list, fit_with: Int32
# ---------- python_9: Python ----------
__author__ = "ytakzk"
__version__ = "2018.12.08"

import rhinoscriptsyntax as rs

box = rs.BoundingBox(mesh)

# domains [[x_min, x_max], [y_min, y_max], [z_min, z_max]]
domain = [
    [999, -999],
    [999, -999],
    [999, -999]
]

for p in box:
    
    for i, v in enumerate(p):
        
        if v < domain[i][0]:
            domain[i][0] = v
            
        elif v > domain[i][1]:
            domain[i][1] = v

max_length = limit[fit_with]

current_length = domain[fit_with][1] - domain[fit_with][0]

scale = max_length / current_length

scaled_mesh = rs.ScaleObject(mesh, [0, 0, 0], [scale, scale, scale], False)
# ---------- end python_9 ----------
mesh_2 = Mesh(python_9)
debox = DeconstructBox(Box=mesh_2)  # -> Plane, X, Y, Z
dedomain = DeconstructDomain(Domain=[debox.X, debox.Y, debox.Z])  # -> Start, End
subtraction = Subtraction(A=dedomain.End, B=dedomain.Start)
panel_7 = Panel(subtraction)

# ----
volume = Volume(Geometry=cull)  # -> Volume, Centroid
wbvertices = WeaverbirdsVerticesComponent(MeshClosedPolylinesGroup=python_9, Weld=True)
dots = DotDisplay(Point=wbvertices, Colour=RGB(242, 27, 12), Size=1)
python_10 = GhPythonScript(m=python_9, ratio=Slider(2.105, range=0..10))  # -> out, decimated_mesh; inputs m: Mesh
# ---------- python_10: Python ----------
__author__ = "ytakzk"
__version__ = "2018.12.07"

import Rhino.Geometry as rg

res = m.CollapseFacesByByAspectRatio(ratio)
print res, 'edges are decimated.'

decimated_mesh = m
# ---------- end python_10 ----------
python_11 = GhPythonScript(m=python_10.decimated_mesh, length=Slider(109, range=0..1000))  # -> out, decimated_mesh; inputs m: Mesh
# ---------- python_11: Python ----------
__author__ = "ytakzk"
__version__ = "2018.12.07"

import Rhino.Geometry as rg

res = m.CollapseFacesByEdgeLength(False, length)
print res, 'edges are decimated.'

decimated_mesh = m
# ---------- end python_11 ----------
python_12 = GhPythonScript(m=python_11.decimated_mesh, ratio=Slider(2.254, range=0..10))  # -> out, decimated_mesh; inputs m: Mesh; same code as python_10
clean_2 = CombineClean(Meshes=python_12.decimated_mesh)
panel_8 = Panel(python_12.out)
panel_9 = Panel(python_11.out)

# ---- group: total length of rods
mesh_3 = Mesh(clean_2)
medges = MeshEdges(Mesh=mesh_3)  # -> NakedEdges, InteriorEdges, NonManifoldEdges
merge_2 = Merge(Data1=medges.NakedEdges, Data2=medges.InteriorEdges, Data3=medges.NonManifoldEdges)
len = Length(Curve=merge_2)
ma = MassAddition(Input=len)  # -> Result, PartialResults

# ----
c_script = CSharpScript(in_run=Button(), in_mesh=mesh_3, in_name="mesh\mesh", in_path=panel_3)  # -> out, A; inputs in_run: Boolean, in_mesh: list of Mesh, in_name: String, in_path: String
# ---------- c_script: C# ----------
    if(in_run) {
      path = System.IO.Path.GetDirectoryName(in_path) + "\\" + in_name + ".obj";
      int faceCount = 0;
      using(StreamWriter writer = new StreamWriter(path)) {
        for(int n = 0; n < in_mesh.Count; n++) {
          List<String> vert = new List<String>();
          List<String> face = new List<String>();

          in_mesh[n].Faces.ConvertQuadsToTriangles();
          BoundingBox bbox = in_mesh[n].GetBoundingBox(true);

          for(int i = 0; i < in_mesh[n].Vertices.Count; i++) {
            vert.Add(String.Format("v {0} {1} {2}", in_mesh[n].Vertices[i].X, in_mesh[n].Vertices[i].Y, in_mesh[n].Vertices[i].Z));
          }

          for(int i = 0; i < in_mesh[n].TextureCoordinates.Count; i++) {
            double tx = in_mesh[n].TextureCoordinates[i].X;
            double ty = in_mesh[n].TextureCoordinates[i].Y;
            vert.Add(String.Format("vt " + tx.ToString("F6") + " " + ty.ToString("F6")));
          }

          for(int i = 0; i < in_mesh[n].Normals.Count; i++) {
            vert.Add(String.Format("vn {0} {1} {2}", in_mesh[n].Normals[i].X, in_mesh[n].Normals[i].Y, in_mesh[n].Normals[i].Z));
          }

          for(int i = 0; i < in_mesh[n].Faces.Count; i++) {
            MeshFace f = in_mesh[n].Faces.GetFace(i);
            int fa = f.A + 1 + faceCount;
            int fb = f.B + 1 + faceCount;
            int fc = f.C + 1 + faceCount;
            string fas = fa.ToString();
            string fbs = fb.ToString();
            string fcs = fc.ToString();
            face.Add(String.Format("f " + fas + "/" + fas + "/" + fas + " " + fbs + "/" + fbs + "/" + fbs + " " + fcs + "/" + fcs + "/" + fcs));
          }

          for(int i = 0; i < vert.Count; i++) {
            writer.WriteLine(vert[i]);
          }

          writer.WriteLine("");
          writer.WriteLine("g " + in_name + n.ToString());

          for(int i = 0; i < face.Count; i++) {
            writer.WriteLine(face[i]);
          }
          faceCount += in_mesh[n].Vertices.Count;
        }
      }
    }
    A = path;
# ---------- c_script: C# additional code ----------
  String path;
# ---------- end c_script ----------
panel_10 = Panel(c_script.A)
panel_11 = Panel(ma.Result)
division = Division(A=ma.Result, B="1000")
bar_graph = BarGraph(len, BarColor=RGB(255, 0, 90))
